# Dynamo graph WatchIfcContent.dyn (Dynamo 2.5.2.7915)

code_block = CodeBlock { "Esser"; "Sebastian"; }
IFC_root = IfcInfraToolkit_Dyn.IFC_root.IFC_root(familyName=code_block.out0, firstName=code_block.out1)
watch_IFC = IfcInfraToolkit_Dyn.IFC_root.Watch_IFC(iFC_root=IFC_root)
