# Dynamo graph debug.dyn (Dynamo 2.5.1.7586)
# packages: IfcInfraToolkit_Dyn 1.0.0

code_block = CodeBlock { "Huber"; "Stefan"; "TUMCMS"; }
ifcBaseService = IfcInfraToolkit_Dyn.IfcBaseService.IfcBaseService(familyName=code_block.out0, firstName=code_block.out1, organization=code_block.out2)
IFC_road_add = IfcInfraToolkit_Dyn.IfcBaseService.IFC_road_add(ifcBaseService=ifcBaseService)  # unwired: stations, width_left, width_right, slope_left, slope_right
code_block_2 = CodeBlock { "sample_ifcroad"; "."; }
IFC_export = IfcInfraToolkit_Dyn.IfcBaseService.IFC_export(ifcBaseService=IFC_road_add, modelName=code_block_2.out0, filepath=code_block_2.out1)
