# Dynamo graph exporter_ifc.dyn (Dynamo 2.5.1.7586)
# packages: Civil3DToolkit 1.1.6

# group: column title
code_block = CodeBlock { ["Station","Hoehe","Streifenbreitelinks","Streifenbreiterechts","Neigunglinks","Neigungrechts"]; }

code_block_2 = CodeBlock()
# ---------- code_block_2.designscript (3 lines) ----------
"Corridor01";
//Change to the Corridor Name
//Maybe Input from User
# ----------------------------------------
code_block_3 = CodeBlock { "LaneSuperelevationAOR - (Right)"; }
code_block_4 = CodeBlock()
# ---------- code_block_4.designscript (3 lines) ----------
"Testachse";
//Change to the Alignment Name
//Maybe Input from User
# ----------------------------------------

# group: Test not needed
current = Autodesk.AutoCAD.DynamoNodes.Document.Current()
alignmentByName = Autodesk.Civil.DynamoNodes.Selection.AlignmentByName(name=code_block_4, document=current)
stations = Autodesk.Civil.DynamoNodes.Alignment.Stations(alignment=alignmentByName)  # unwired: interval
profileByName = Autodesk.Civil.DynamoNodes.Alignment.ProfileByName(alignment=alignmentByName)  # unwired: name

corridorByName = Autodesk.Civil.DynamoNodes.Selection.CorridorByName(name=code_block_2, document=current)
baselines = Autodesk.Civil.DynamoNodes.Corridor.Baselines(corridor=corridorByName)
regions = Autodesk.Civil.DynamoNodes.Baseline.Regions(baseline=baselines)
stations_2 = Autodesk.Civil.DynamoNodes.BaselineRegion.Stations(baselineRegion=regions)
flatten = List.Flatten(list=stations_2)
elevationByStation = Autodesk.Civil.DynamoNodes.Baseline.ElevationByStation(baseline=baselines, station=stations_2)
flatten_2 = List.Flatten(list=elevationByStation)
subassembliesByStation = Autodesk.Civil.DynamoNodes.Baseline.SubassembliesByStation(baseline=baselines, station=stations_2)
name = Autodesk.Civil.DynamoNodes.AppliedSubassembly.Name(appliedSubassembly=subassembliesByStation)
eq = name == code_block_3
filterByBoolMask = List.FilterByBoolMask(list=subassembliesByStation, mask=eq)

# group: Filtern nach Fahrstreifen
name_2 = Autodesk.Civil.DynamoNodes.AppliedSubassembly.Name(appliedSubassembly=subassembliesByStation)
code_block_5 = CodeBlock { "LaneSuperelevationAOR"; }
eq_2 = name_2 == code_block_5
code_block_6 = CodeBlock { "LaneSuperelevationAOR - (Left)"; }
eq_3 = name_2 == code_block_6
filterByBoolMask_2 = List.FilterByBoolMask(list=subassembliesByStation, mask=eq_3)

filterByBoolMask_3 = List.FilterByBoolMask(list=subassembliesByStation, mask=eq_2)

# group: Add on Lanes
parameters = Autodesk.Civil.DynamoNodes.AppliedSubassembly.Parameters(appliedSubassembly=filterByBoolMask_3.in)
name_3 = Autodesk.Civil.DynamoNodes.SubassemblyParameter.Name(subassemblyParameter=parameters)
code_block_7 = CodeBlock()
# ---------- code_block_7.designscript (2 lines) ----------
"Seite";
//Probably need to change to C3D language
# ----------------------------------------
eq_4 = name_3 == code_block_7
filterByBoolMask_4 = List.FilterByBoolMask(list=parameters, mask=eq_4)
value = Autodesk.Civil.DynamoNodes.SubassemblyParameter.Value(subassemblyParameter=filterByBoolMask_4.in)
code_block_8 = CodeBlock { 2; }
flatten_3 = List.Flatten(list=value, amt=code_block_8)
empty_to_null = Python(IN[0]=flatten_3)
# ---------- empty_to_null.python (48 lines) ----------
# Load the Python Standard and DesignScript Libraries
import sys
import clr

# Add Assemblies for AutoCAD and Civil3D
clr.AddReference('AcMgd')
clr.AddReference('AcCoreMgd')
clr.AddReference('AcDbMgd')
clr.AddReference('AecBaseMgd')
clr.AddReference('AecPropDataMgd')
clr.AddReference('AeccDbMgd')

# Import references from AutoCAD
from Autodesk.AutoCAD.Runtime import *
from Autodesk.AutoCAD.ApplicationServices import *
from Autodesk.AutoCAD.EditorInput import *
from Autodesk.AutoCAD.DatabaseServices import *
from Autodesk.AutoCAD.Geometry import *

# Import references from Civil3D
from Autodesk.Civil.ApplicationServices import *
from Autodesk.Civil.DatabaseServices import *

# The inputs to this node will be stored as a list in the IN variables.
dataEnteringNode = IN

adoc = Application.DocumentManager.MdiActiveDocument
editor = adoc.Editor

data=IN[0]
re=[];

with adoc.LockDocument():
    with adoc.Database as db:

        with db.TransactionManager.StartTransaction() as t:
            if data!=None:
                for i in range(len(data)):
                    if len(data[i]) == 0:#check if the list is empty -> replace with none
                        re.append(None)
                        continue
                    re.append(data[i])
            if data==None:
                re=None	        
            pass

# Assign your output to the OUT variable.
OUT = re
# ----------------------------------------
name_4 = Autodesk.Civil.DynamoNodes.SubassemblyParameter.Name(subassemblyParameter=parameters)
code_block_9 = CodeBlock { "Fahrstreifenbreite"; }
eq_5 = name_4 == code_block_9
filterByBoolMask_5 = List.FilterByBoolMask(list=parameters, mask=eq_5)
value_2 = Autodesk.Civil.DynamoNodes.SubassemblyParameter.Value(subassemblyParameter=filterByBoolMask_5.in)
flatten_4 = List.Flatten(list=value_2, amt=code_block_8)
empty_to_null_2 = Python(IN[0]=flatten_4)  # same code as empty_to_null
rightlanes_into_list = Python(IN[0]=empty_to_null, IN[1]=empty_to_null_2)
# ---------- rightlanes_into_list.python (58 lines) ----------
# Load the Python Standard and DesignScript Libraries
import sys
import clr

# Add Assemblies for AutoCAD and Civil3D
clr.AddReference('AcMgd')
clr.AddReference('AcCoreMgd')
clr.AddReference('AcDbMgd')
clr.AddReference('AecBaseMgd')
clr.AddReference('AecPropDataMgd')
clr.AddReference('AeccDbMgd')

# Import references from AutoCAD
from Autodesk.AutoCAD.Runtime import *
from Autodesk.AutoCAD.ApplicationServices import *
from Autodesk.AutoCAD.EditorInput import *
from Autodesk.AutoCAD.DatabaseServices import *
from Autodesk.AutoCAD.Geometry import *

# Import references from Civil3D
from Autodesk.Civil.ApplicationServices import *
from Autodesk.Civil.DatabaseServices import *

# The inputs to this node will be stored as a list in the IN variables.
dataEnteringNode = IN

adoc = Application.DocumentManager.MdiActiveDocument
editor = adoc.Editor

# setup of var
side = IN[0];
data = IN[1];

sum = 0;

right = [];

with adoc.LockDocument():
    with adoc.Database as db:

        with db.TransactionManager.StartTransaction() as t:
            if side != None and data != None:
                for i in range(len(data)):
                    if data[i] == None:  # check if there is a a length for the crosssection
                        right.append(None)
                        continue
                    for j in range(len(data[i])):  # if there are more lanes on one site sum them up
                        if side[i][j][0] == 1:
                            sum += data[i][j][0]

                    right.append(sum)
                    sum = 0
            else:
                right = None
        pass

# Assign your output to the OUT variable.
OUT = right
# ----------------------------------------
flatten_5 = List.Flatten(list=rightlanes_into_list)
python_script = Python(IN[0]=empty_to_null, IN[1]=empty_to_null_2)
# ---------- python_script.python (58 lines) ----------
# Load the Python Standard and DesignScript Libraries
import sys
import clr

# Add Assemblies for AutoCAD and Civil3D
clr.AddReference('AcMgd')
clr.AddReference('AcCoreMgd')
clr.AddReference('AcDbMgd')
clr.AddReference('AecBaseMgd')
clr.AddReference('AecPropDataMgd')
clr.AddReference('AeccDbMgd')

# Import references from AutoCAD
from Autodesk.AutoCAD.Runtime import *
from Autodesk.AutoCAD.ApplicationServices import *
from Autodesk.AutoCAD.EditorInput import *
from Autodesk.AutoCAD.DatabaseServices import *
from Autodesk.AutoCAD.Geometry import *

# Import references from Civil3D
from Autodesk.Civil.ApplicationServices import *
from Autodesk.Civil.DatabaseServices import *

# The inputs to this node will be stored as a list in the IN variables.
dataEnteringNode = IN

adoc = Application.DocumentManager.MdiActiveDocument
editor = adoc.Editor

# setup of var
side = IN[0];
data = IN[1];

sum = 0;

right = [];

with adoc.LockDocument():
    with adoc.Database as db:

        with db.TransactionManager.StartTransaction() as t:
            if side != None and data != None:
                for i in range(len(data)):
                    if data[i] == None:  # check if there is a a length for the crosssection
                        right.append(None)
                        continue
                    for j in range(len(data[i])):  # if there are more lanes on one site sum them up
                        if side[i][j][0] == 0:
                            sum += data[i][j][0]

                    right.append(sum)
                    sum = 0
            else:
                right = None
        pass

# Assign your output to the OUT variable.
OUT = right
# ----------------------------------------
flatten_6 = List.Flatten(list=python_script)
code_block_10 = CodeBlock()
# ---------- code_block_10.designscript (2 lines) ----------
//Left ==1
//Right ==0
# ----------------------------------------

# group: Lane Right
parameters_2 = Autodesk.Civil.DynamoNodes.AppliedSubassembly.Parameters(appliedSubassembly=filterByBoolMask.in)
name_5 = Autodesk.Civil.DynamoNodes.SubassemblyParameter.Name(subassemblyParameter=parameters_2)
code_block_11 = CodeBlock { "Fahrstreifenbreite"; }
eq_6 = name_5 == code_block_11
filterByBoolMask_6 = List.FilterByBoolMask(list=parameters_2, mask=eq_6)
value_3 = Autodesk.Civil.DynamoNodes.SubassemblyParameter.Value(subassemblyParameter=filterByBoolMask_6.in)
code_block_12 = CodeBlock { 2; }
flatten_7 = List.Flatten(list=value_3, amt=code_block_12)
replace_empty_to_null = Python(IN[0]=flatten_7)
# ---------- replace_empty_to_null.python (45 lines) ----------
# Load the Python Standard and DesignScript Libraries
import sys
import clr

# Add Assemblies for AutoCAD and Civil3D
clr.AddReference('AcMgd')
clr.AddReference('AcCoreMgd')
clr.AddReference('AcDbMgd')
clr.AddReference('AecBaseMgd')
clr.AddReference('AecPropDataMgd')
clr.AddReference('AeccDbMgd')

# Import references from AutoCAD
from Autodesk.AutoCAD.Runtime import *
from Autodesk.AutoCAD.ApplicationServices import *
from Autodesk.AutoCAD.EditorInput import *
from Autodesk.AutoCAD.DatabaseServices import *
from Autodesk.AutoCAD.Geometry import *

# Import references from Civil3D
from Autodesk.Civil.ApplicationServices import *
from Autodesk.Civil.DatabaseServices import *

# The inputs to this node will be stored as a list in the IN variables.
dataEnteringNode = IN

adoc = Application.DocumentManager.MdiActiveDocument
editor = adoc.Editor

data=IN[0]
re=[];

with adoc.LockDocument():
    with adoc.Database as db:

        with db.TransactionManager.StartTransaction() as t:
            for i in range(len(data)):
            	if len(data[i]) == 0:#check if the list is empty -> replace with none
            		re.append(None)
            		continue
            	re.append(data[i])
            pass

# Assign your output to the OUT variable.
OUT = re
# ----------------------------------------
flatten_8 = List.Flatten(list=replace_empty_to_null)
custom_sum = Python(IN[0]=flatten_8, IN[1]=flatten_5, IN[2]=flatten)
# ---------- custom_sum.python (64 lines) ----------
# Load the Python Standard and DesignScript Libraries
import sys
import clr

# Add Assemblies for AutoCAD and Civil3D
clr.AddReference('AcMgd')
clr.AddReference('AcCoreMgd')
clr.AddReference('AcDbMgd')
clr.AddReference('AecBaseMgd')
clr.AddReference('AecPropDataMgd')
clr.AddReference('AeccDbMgd')

# Import references from AutoCAD
from Autodesk.AutoCAD.Runtime import *
from Autodesk.AutoCAD.ApplicationServices import *
from Autodesk.AutoCAD.EditorInput import *
from Autodesk.AutoCAD.DatabaseServices import *
from Autodesk.AutoCAD.Geometry import *

# Import references from Civil3D
from Autodesk.Civil.ApplicationServices import *
from Autodesk.Civil.DatabaseServices import *

# The inputs to this node will be stored as a list in the IN variables.
dataEnteringNode = IN

adoc = Application.DocumentManager.MdiActiveDocument
editor = adoc.Editor

x=IN[0];
y=IN[1];
count=IN[2];
#Add your Input here and below

result=[];


with adoc.LockDocument():
    with adoc.Database as db:

        with db.TransactionManager.StartTransaction() as t:
            if x==None and y==None:
            	for i in range(len(count)):
                	result.append(None)
            elif x==None:
                result=y
            elif y==None:
                result=x;
            else:
                for i in range(len(x)):
                    if x[i]==None:#Both null ->null elseif the other get is valid ->set -> else both valid -> add them up
                        if y[i]==None:
                            result.append(None)
                            continue
                        result.append(y[i])
                        continue
                    if y[i]==None:
                        result.append(x[i])
                        continue
                    result.append(x[i]+y[i])
            pass

# Assign your output to the OUT variable.
OUT = result
# ----------------------------------------
code_block_13 = CodeBlock()  # //Rightlane

# group: Lane Left
parameters_3 = Autodesk.Civil.DynamoNodes.AppliedSubassembly.Parameters(appliedSubassembly=filterByBoolMask_2.in)
name_6 = Autodesk.Civil.DynamoNodes.SubassemblyParameter.Name(subassemblyParameter=parameters_3)
code_block_14 = CodeBlock()
# ---------- code_block_14.designscript (2 lines) ----------
"Fahrstreifenbreite";
//Probably need to change to C3D language
# ----------------------------------------
eq_7 = name_6 == code_block_14
filterByBoolMask_7 = List.FilterByBoolMask(list=parameters_3, mask=eq_7)
value_4 = Autodesk.Civil.DynamoNodes.SubassemblyParameter.Value(subassemblyParameter=filterByBoolMask_7.in)
code_block_15 = CodeBlock { 2; }
flatten_9 = List.Flatten(list=value_4, amt=code_block_15)
replace_empty_to_null_2 = Python(IN[0]=flatten_9)  # same code as replace_empty_to_null
flatten_10 = List.Flatten(list=replace_empty_to_null_2)
python_script_2 = Python(IN[0]=flatten_10, IN[1]=flatten_6, IN[2]=flatten)  # same code as custom_sum
code_block_16 = CodeBlock()  # //leftlane

alignment = Autodesk.Civil.DynamoNodes.Baseline.Alignment(baseline=baselines)
unzip_alignment = Python(IN[0]=alignment)
# ---------- unzip_alignment.python (38 lines) ----------
# Load the Python Standard and DesignScript Libraries
import sys
import clr

# Add Assemblies for AutoCAD and Civil3D
clr.AddReference('AcMgd')
clr.AddReference('AcCoreMgd')
clr.AddReference('AcDbMgd')
clr.AddReference('AecBaseMgd')
clr.AddReference('AecPropDataMgd')
clr.AddReference('AeccDbMgd')

# Import references from AutoCAD
from Autodesk.AutoCAD.Runtime import *
from Autodesk.AutoCAD.ApplicationServices import *
from Autodesk.AutoCAD.EditorInput import *
from Autodesk.AutoCAD.DatabaseServices import *
from Autodesk.AutoCAD.Geometry import *

# Import references from Civil3D
from Autodesk.Civil.ApplicationServices import *
from Autodesk.Civil.DatabaseServices import *

# The inputs to this node will be stored as a list in the IN variables.
dataEnteringNode = IN

adoc = Application.DocumentManager.MdiActiveDocument
editor = adoc.Editor

with adoc.LockDocument():
    with adoc.Database as db:

        with db.TransactionManager.StartTransaction() as t:
            
            pass

# Assign your output to the OUT variable.
OUT = IN[0][0]
# ----------------------------------------
flatten_11 = List.Flatten(list=stations_2)
getSlopeAtStation = Autodesk.Civil.DynamoNodes.AlignmentExtensions.GetSlopeAtStation(alignment=unzip_alignment, station=flatten_11)

# group: packaging + test output
list_create = List.Create(item0=flatten, item1=flatten_2, item2=custom_sum, item3=python_script_2, item4=getSlopeAtStation.RightOutLaneCrossSlope, item5=getSlopeAtStation.LeftOutLaneCrossSlope)
transpose = List.Transpose(lists=list_create)
code_block_17 = CodeBlock { 3; }
round = Math.Round(number=transpose, digits=code_block_17)
output_Selection = Python(IN[0]=round)
# ---------- output_Selection.python (66 lines) ----------
# Load the Python Standard and DesignScript Libraries
import sys
import clr

# Add Assemblies for AutoCAD and Civil3D
clr.AddReference('AcMgd')
clr.AddReference('AcCoreMgd')
clr.AddReference('AcDbMgd')
clr.AddReference('AecBaseMgd')
clr.AddReference('AecPropDataMgd')
clr.AddReference('AeccDbMgd')

# Import references from AutoCAD
from Autodesk.AutoCAD.Runtime import *
from Autodesk.AutoCAD.ApplicationServices import *
from Autodesk.AutoCAD.EditorInput import *
from Autodesk.AutoCAD.DatabaseServices import *
from Autodesk.AutoCAD.Geometry import *

# Import references from Civil3D
from Autodesk.Civil.ApplicationServices import *
from Autodesk.Civil.DatabaseServices import *

# The inputs to this node will be stored as a list in the IN variables.
dataEnteringNode = IN

adoc = Application.DocumentManager.MdiActiveDocument
editor = adoc.Editor

data = IN[0];
ret=[data[0]];

#TODO Add Offset 
#maybe here are some info: http://docs.autodesk.com/CIV3D/2019/ENU/API_Reference_Guide/index.html



with adoc.LockDocument():
    with adoc.Database as db:

        with db.TransactionManager.StartTransaction() as t:
        #fancy Output
            for i in range(len(data)):
                editor.WriteMessage("\n")
                if (i == 0):  # First crosssection 
                    for j in range(len(data[i])):#Crosssection output
                        editor.WriteMessage("\t" + str(data[i][j]))

                    editor.WriteMessage("\t" + str(0.000))  # Here add the Offset
                    editor.WriteMessage("\t" + str(0.000))
                    continue
				#Check if the crosssection has changed
                for n in range(len(data[i])-2):
                	if data[i][n+2]!=data[i-1][n+2]:
						for j in range(len(data[i])):#Crosssection output
							editor.WriteMessage("\t" + str(data[i][j]))
							
						editor.WriteMessage("\t"+ str(0.0))
						editor.WriteMessage("\t"+ str(0.0))
						ret.append(data[i]);						
						break

            pass

# Assign your output to the OUT variable.
OUT = ret
# ----------------------------------------
code_block_18 = CodeBlock()
# ---------- code_block_18.designscript (2 lines) ----------
//IF Math.Round throw a warning then there
//is probably a unknown crosssection
# ----------------------------------------

# group: Export
file_path = Filename("..\Export\simple_export.csv")
addItemToFront = List.AddItemToFront(item=code_block, list=output_Selection)
exportCSV = Data.ExportCSV(filePath=file_path, data=addItemToFront)

# group: Not necessary
startStation = Autodesk.Civil.DynamoNodes.BaselineRegion.StartStation(baselineRegion=regions)
subassembliesByStation_2 = Autodesk.Civil.DynamoNodes.Baseline.SubassembliesByStation(baseline=baselines, station=startStation)
parameters_4 = Autodesk.Civil.DynamoNodes.AppliedSubassembly.Parameters(appliedSubassembly=subassembliesByStation_2)
flatten_12 = List.Flatten(list=parameters_4)
name_7 = Autodesk.Civil.DynamoNodes.SubassemblyParameter.Name(subassemblyParameter=flatten_12)
value_5 = Autodesk.Civil.DynamoNodes.SubassemblyParameter.Value(subassemblyParameter=flatten_12)
name_8 = Autodesk.Civil.DynamoNodes.AppliedSubassembly.Name(appliedSubassembly=subassembliesByStation_2)
code_block_19 = CodeBlock { "LaneSuperelevationAOR - (Left)"; }
eq_8 = name_8 == code_block_19
code_block_20 = CodeBlock { "LaneSuperelevationAOR - (Right)"; }
eq_9 = name_8 == code_block_20
or_ = eq_8 || eq_9
code_block_21 = CodeBlock { "LaneSuperelevationAOR"; }
eq_10 = name_8 == code_block_21
or_2 = or_ || eq_10
filterByBoolMask_8 = List.FilterByBoolMask(list=subassembliesByStation_2, mask=or_2)

code_block_22 = CodeBlock { /*Export der Daten an den Stützstellen*/; }
code_block_23 = CodeBlock()  # //Currently only the first Alingement
code_block_24 = CodeBlock { "Huber"; "Stefan"; "TUMCMS"; }
IFC_root = IfcInfraToolkit_Dyn.IFC_root.IFC_root(familyName=code_block_24.out0, firstName=code_block_24.out1, organization=code_block_24.out2)
IFC_road_add = IfcInfraToolkit_Dyn.IFC_root.IFC_road_add(iFC_root=IFC_root, stations=flatten, width_left=python_script_2, width_right=custom_sum, slope_left=getSlopeAtStation.LeftOutLaneCrossSlope, slope_right=getSlopeAtStation.RightOutLaneCrossSlope)
code_block_25 = CodeBlock { "sample_ifcroad"; "."; }
IFC_export = IfcInfraToolkit_Dyn.IFC_root.IFC_export(iFC_root=IFC_road_add, modelName=code_block_25.out0, filepath=code_block_25.out1)
code_block_26 = CodeBlock {  }
