# Dynamo graph CreateAndStoreIFC.dyn (Dynamo 2.11.0.4533)

# group: Create IFC model
createIfcModel = IfcInfraToolKit_DynamoCore.IfcModelSetup.CreateIfcModel()

# note: Enter a suitable path here!
directory_path = Directory("C:\dev")
code_block = CodeBlock { "mySampleModel"; }

# group: Save IFC model
saveIfcModel = IfcInfraToolKit_DynamoCore.IfcModelSetup.SaveIfcModel(container=createIfcModel, path=directory_path, modelName=code_block)
