# Dynamo graph OpenExistingModel_01.dyn "OpenExistingModel" (Dynamo 2.11.0.4533)

# note: Select Path to IFC model
file_path = Filename(".\GeomSample.ifc")
openIfcModel = IfcInfraToolKit_DynamoCore.IfcModelSetup.OpenIfcModel(path=file_path)
getSpatialStructureItems = IfcInfraToolKit_DynamoCore.IfcModelSetup.GetSpatialStructureItems(databaseContainer=openIfcModel)
getElementItems = IfcInfraToolKit_DynamoCore.IfcModelSetup.GetElementItems(databaseContainer=openIfcModel)
watch = Watch(getElementItems.IfcClasses)
watch_2 = Watch(getElementItems.Names)
getObjectDefinitionItems = IfcInfraToolKit_DynamoCore.IfcModelSetup.GetObjectDefinitionItems(databaseContainer=openIfcModel)
watch_3 = Watch(getObjectDefinitionItems.IfcClasses)
