# Dynamo graph CreateBridge.dyn (Dynamo 2.11.0.4533)

createIfcModel = IfcInfraToolKit_DynamoCore.IfcModelSetup.CreateIfcModel()
code_block = CodeBlock { "null"; }
code_block_2 = CodeBlock { "testBridge"; }
addBridge = IfcInfraToolKit_DynamoCore.SpatialStructureDesigner.AddBridge(databaseContainer=createIfcModel, hostGuid=code_block, bridgeName=code_block_2)
getObjectDefinitionItems = IfcInfraToolKit_DynamoCore.IfcModelSetup.GetObjectDefinitionItems(databaseContainer=addBridge.DatabaseContainer)
watch = Watch(getObjectDefinitionItems.IfcClasses)
