# Dynamo graph CreateSpatialStructure_simple.dyn (Dynamo 2.11.0.4533)

code_block = CodeBlock { "null"; }
# note: If hostGuid is set to null, the top IfcSite entity is used as the host item.
code_block_2 = CodeBlock { "Technical University of Munich"; }
code_block_3 = CodeBlock { "null"; }
code_block_4 = CodeBlock { "Arcisstrasse 19"; }
directory_path = Directory("C:\dev")
code_block_5 = CodeBlock { "CreateSpatialStructure_simple"; }

# group: IFC
# note: Init IFC model
createIfcModel = IfcInfraToolKit_DynamoCore.IfcModelSetup.CreateIfcModel()
# note: Add Facility
addFacility = IfcInfraToolKit_DynamoCore.SpatialStructureDesigner.AddFacility(databaseContainer=createIfcModel, hostGuid=code_block, facilityName=code_block_2)
# note: Add Road
addRoad = IfcInfraToolKit_DynamoCore.SpatialStructureDesigner.AddRoad(databaseContainer=addFacility.DatabaseContainer, hostGuid=code_block_3, roadName=code_block_4)
saveIfcModel = IfcInfraToolKit_DynamoCore.IfcModelSetup.SaveIfcModel(container=addRoad.DatabaseContainer, path=directory_path, modelName=code_block_5)
