# Dynamo graph CreateSpatialStructure_withPDTs.dyn (Dynamo 2.12.0.5650)

# group: User Input
code_block = CodeBlock { "null"; "SampleFacility"; }
code_block_2 = CodeBlock { "Section1"; }
directory_path = Directory("C:\Users\ga38hep\Desktop")
code_block_3 = CodeBlock { "CreateSpatialStructure-sandbox"; }

# group: IFC model composition
# note: Init IFC model
createIfcModel = IfcInfraToolKit_DynamoCore.IfcModelSetup.CreateIfcModel()

addFacility = IfcInfraToolKit_DynamoCore.SpatialStructureDesigner.AddFacility(databaseContainer=createIfcModel, hostGuid=code_block.out0, facilityName=code_block.out1)

# group: Observe IFC content
watch = Watch(addFacility.FacilityGUID)

# group: PDT Category
# note: Build inputs for "AddFacilityPart"
getAvailableFacilityPartTypes = IfcInfraToolKit_DynamoCore.SpatialStructureDesigner.GetAvailableFacilityPartTypes()
watch_2 = Watch(getAvailableFacilityPartTypes)
code_block_4 = CodeBlock(list=watch_2) { item = list[3]; }
watch_3 = Watch(code_block_4)

# group: Predefined type
getPredefinedType = IfcInfraToolKit_DynamoCore.SpatialStructureDesigner.GetPredefinedType(facilityPartEnum=watch_3)
watch_4 = Watch(getPredefinedType)
code_block_5 = CodeBlock(list=watch_4) { item = list[6]; }
watch_5 = Watch(code_block_5)

# group: UsageType
getPredefinedFacilityPartUsage = IfcInfraToolKit_DynamoCore.SpatialStructureDesigner.GetPredefinedFacilityPartUsage()
watch_6 = Watch(getPredefinedFacilityPartUsage)
firstItem = List.FirstItem(list=watch_6)

addFacilityPart = IfcInfraToolKit_DynamoCore.SpatialStructureDesigner.AddFacilityPart(databaseContainer=addFacility.DatabaseContainer, hostGuid=watch, name=code_block_2, facilityType=watch_3, facilityPartType=watch_5, usageType=firstItem)

# group (continued): IFC model composition
# note: Save model
saveIfcModel = IfcInfraToolKit_DynamoCore.IfcModelSetup.SaveIfcModel(databaseContainer=addFacilityPart.DatabaseContainer, path=directory_path, modelName=code_block_3)

# group (continued): Observe IFC content
watch_7 = Watch(addFacilityPart.FacilityPartGUID)
getSpatialStructureItems = IfcInfraToolKit_DynamoCore.IfcModelSetup.GetSpatialStructureItems(databaseContainer=addFacilityPart.DatabaseContainer)
watch_8 = Watch(getSpatialStructureItems.IfcClasses)
