# Dynamo graph CreateElement_semantic.dyn (Dynamo 2.11.0.4533)

code_block = CodeBlock { "myIFCmodel"; "testFacility"; }

# group: Define base model skeleton
createIfcModel = IfcInfraToolKit_DynamoCore.IfcModelSetup.CreateIfcModel(projectName=code_block.out0, siteName=code_block.out0)
addFacility = IfcInfraToolKit_DynamoCore.SpatialStructureDesigner.AddFacility(databaseContainer=createIfcModel, hostGuid=code_block.out0, facilityName=code_block.out1)

# group: Choose suitable IfcProduct class
getAvailableBuiltElementClassNames = IfcInfraToolKit_DynamoCore.ElementDesigner.GetAvailableBuiltElementClassNames()
watch = Watch(getAvailableBuiltElementClassNames)
code_block_2 = CodeBlock(list=watch) { item = list[16]; }

code_block_3 = CodeBlock { "road pavement"; }

# group: Add element to model
# note: Add semantic element to IFC model
addBuiltElement = IfcInfraToolKit_DynamoCore.ElementDesigner.AddBuiltElement(databaseContainer=addFacility.DatabaseContainer, IfcClass=code_block_2, elementName=code_block_3, hostGuid=addFacility.FacilityGUID)

# group: check result
getElementItems = IfcInfraToolKit_DynamoCore.IfcModelSetup.GetElementItems(databaseContainer=addBuiltElement.DatabaseContainer)
watch_2 = Watch(getElementItems.Names)
watch_3 = Watch(getElementItems.IfcClasses)
