# Dynamo graph cuboidBridge.dyn (Dynamo 2.11.0.4533)

# group: Deck geometry
code_block = CodeBlock { 0.2; 12; 7; }
byLengths = Cuboid.ByLengths(width=code_block.out2, length=code_block.out1, height=code_block.out0)
code_block_2 = CodeBlock { 5; }
code_block_3 = CodeBlock { 2.1; }
translate = Geometry.Translate(geometry=byLengths, yTranslation=code_block_2, zTranslation=code_block_3)

# group: Abutment 2
code_block_4 = CodeBlock { 6; 0.8; 4; }
byLengths_2 = Cuboid.ByLengths(width=code_block_4.out0, length=code_block_4.out1, height=code_block_4.out2)

# group: Abutment 1
code_block_5 = CodeBlock { 6; 0.8; 4; }
byLengths_3 = Cuboid.ByLengths(width=code_block_5.out0, length=code_block_5.out1, height=code_block_5.out2)
code_block_6 = CodeBlock { 10; }
translate_2 = Geometry.Translate(geometry=byLengths_3, yTranslation=code_block_6)

code_block_7 = CodeBlock { "Generic bridge project"; }
code_block_8 = CodeBlock { "site item for test bridge"; }
createIfcModel = IfcInfraToolKit_DynamoCore.IfcModelSetup.CreateIfcModel(projectName=code_block_7, siteName=code_block_8)
code_block_9 = CodeBlock()
# ---------- code_block_9.designscript (2 lines) ----------
// take tomost site item as host
"null";
# ----------------------------------------
code_block_10 = CodeBlock { "test bridge"; }
addBridge = IfcInfraToolKit_DynamoCore.SpatialStructureDesigner.AddBridge(databaseContainer=createIfcModel, hostGuid=code_block_9, bridgeName=code_block_10)

# group: Abutment 1 - semantic
getAvailableBuiltElementClassNames = IfcInfraToolKit_DynamoCore.ElementDesigner.GetAvailableBuiltElementClassNames()
watch = Watch(getAvailableBuiltElementClassNames)
code_block_11 = CodeBlock(list=watch) { item = list[28]; }
code_block_12 = CodeBlock { "Abutment wall 01"; }
addBuiltElement = IfcInfraToolKit_DynamoCore.ElementDesigner.AddBuiltElement(databaseContainer=addBridge.DatabaseContainer, IfcClass=code_block_11, elementName=code_block_12, hostGuid=addBridge.BridgeGUID)

# group: Abutment 1 - semantic
getAvailableBuiltElementClassNames_2 = IfcInfraToolKit_DynamoCore.ElementDesigner.GetAvailableBuiltElementClassNames()
watch_2 = Watch(getAvailableBuiltElementClassNames_2)
code_block_13 = CodeBlock(list=watch_2) { item = list[28]; }
code_block_14 = CodeBlock { "Abutment wall 02"; }
addBuiltElement_2 = IfcInfraToolKit_DynamoCore.ElementDesigner.AddBuiltElement(databaseContainer=addBuiltElement.DatabaseContainer, IfcClass=code_block_13, elementName=code_block_14, hostGuid=addBridge.BridgeGUID)

# group: Deck 1 - semantic
getAvailableBuiltElementClassNames_3 = IfcInfraToolKit_DynamoCore.ElementDesigner.GetAvailableBuiltElementClassNames()
watch_3 = Watch(getAvailableBuiltElementClassNames_3)
code_block_15 = CodeBlock(list=watch_3) { item = list[24]; }
code_block_16 = CodeBlock { "Abutment wall 02"; }
addBuiltElement_3 = IfcInfraToolKit_DynamoCore.ElementDesigner.AddBuiltElement(databaseContainer=addBuiltElement_2.DatabaseContainer, IfcClass=code_block_15, elementName=code_block_16, hostGuid=addBridge.BridgeGUID)

# group: Abutment 1 - geometry
addSolidGeometryAsBRep = IfcInfraToolKit_DynamoCore.DynamoGeometryExporter.AddSolidGeometryAsBRep(solidGeometry=translate_2, databaseContainer=addBuiltElement_3.DatabaseContainer, elementGuid=addBuiltElement.ElementGUID)

# group: Abutment 2 - geometry
addSolidGeometryAsBRep_2 = IfcInfraToolKit_DynamoCore.DynamoGeometryExporter.AddSolidGeometryAsBRep(solidGeometry=byLengths_2, databaseContainer=addSolidGeometryAsBRep.DatabaseContainer, elementGuid=addBuiltElement_2.ElementGUID)

# group: Deck - geometry
addSolidGeometryAsBRep_3 = IfcInfraToolKit_DynamoCore.DynamoGeometryExporter.AddSolidGeometryAsBRep(solidGeometry=translate, databaseContainer=addSolidGeometryAsBRep_2.DatabaseContainer, elementGuid=addBuiltElement_3.ElementGUID)

# group: Save IFC model
directory_path = Directory("C:\dev")
code_block_17 = CodeBlock { "cuboidBridge"; }
saveIfcModel = IfcInfraToolKit_DynamoCore.IfcModelSetup.SaveIfcModel(databaseContainer=addSolidGeometryAsBRep_3.DatabaseContainer, path=directory_path, modelName=code_block_17)
