# Dynamo graph geometryLofting.dyn (Dynamo 2.11.1.4675)

XY = Plane.XY()
code_block = CodeBlock { 3; }
code_block_2 = CodeBlock { 3; }
byWidthLength = Rectangle.ByWidthLength(plane=XY, width=code_block, length=code_block_2)
code_block_3 = CodeBlock { 10; }
offset = Plane.Offset(plane=XY, dist=code_block_3)
code_block_4 = CodeBlock { 10; 10; }
byWidthLength_2 = Rectangle.ByWidthLength(plane=offset, width=code_block_4.out0, length=code_block_4.out1)
code_block_5 = CodeBlock { 20; }
offset_2 = Plane.Offset(plane=XY, dist=code_block_5)
code_block_6 = CodeBlock { 10; }
byPlaneRadius = Circle.ByPlaneRadius(plane=offset_2, radius=code_block_6)
code_block_7 = CodeBlock { 4; }
regularPolygon = Polygon.RegularPolygon(circle=byPlaneRadius, numberSides=code_block_7)
list_create = List.Create(item0=byWidthLength, item1=byWidthLength_2, item2=regularPolygon)
byLoft = Solid.ByLoft(crossSections=list_create)
