# Dynamo graph RevitMeshExport.dyn (Dynamo 2.5.0.7460)

categories = Categories("OST_BridgeFoundations")
all_elements_of_category = ElementsOfCategory(Category=categories)
geometry = Element.Geometry(element=all_elements_of_category)
flatten = List.Flatten(list=geometry)
faceIndices = Mesh.FaceIndices(mesh=flatten)
vertexPositions = Mesh.VertexPositions(mesh=flatten)
