# Dynamo graph ForgeDynIntegration.dyn (Dynamo 2.5.2.7915)
# packages: Civil3DToolkit 1.1.6

# group: Authenticate
code_block = CodeBlock { clientId = "uAZ8dG4WdiyAb9N1Dk6PY0lQFLVZV1pi"; clientSecret = "OfWOLHtYSV34YRZU"; }
byClientIdAndSecret = Collaboration.Forge.Token.ByClientIdAndSecret(ClientId=code_block.clientId, ClientSecret=code_block.clientSecret)
accesToken = Collaboration.Forge.Token.AccesToken(token=byClientIdAndSecret)

# group: Get all hubs and containing projects
getAllHubs = Collaboration.Forge.Hub.GetAllHubs(AccessToken=accesToken)
getAllProjects = Collaboration.Forge.Project.GetAllProjects(Hub=getAllHubs)
name = Collaboration.Forge.Project.Name(project=getAllProjects)

# group: Get folders of project
code_block_2 = CodeBlock(list=getAllProjects) { proj = list[0][6]; }
name_2 = Collaboration.Forge.Project.Name(project=code_block_2)
getTopFolders = Collaboration.Forge.Folder.GetTopFolders(Project=code_block_2)
name_3 = Collaboration.Forge.Folder.Name(folder=getTopFolders)

code_block_3 = CodeBlock(list=getTopFolders) { item = list[8]; }
