# Dynamo graph Alignment+BridgeDeck.dyn (Dynamo 2.6.1.8786)

# group: Load alignment curve
file_path = Filename("..\alignmentFiles\Segura_bridge_alignment.csv")
importAlignmentAsPoints = IfcInfraToolKit_DynamoCore.AlignmentImporter.ImportAlignmentAsPoints(csvPath=file_path)
count = List.Count(list=importAlignmentAsPoints)
code_block = CodeBlock(a=count) { 3; b = a -4; }
slice = List.Slice(list=importAlignmentAsPoints, start=code_block.out0, end=code_block.b)
byBestFitThroughPoints = Line.ByBestFitThroughPoints(bestFitPoints=slice)
number_slider = DoubleSlider(0.05, range=0..1 step 0.05)
pointAtParameter = Curve.PointAtParameter(curve=byBestFitThroughPoints, param=number_slider)
direction = Line.Direction(line=byBestFitThroughPoints)

# group: Dimension
number_slider_2 = DoubleSlider(0.2, range=0..2 step 0.1)
number_slider_3 = DoubleSlider(5.6, range=0..6 step 0.2)

# group: Offset
number_slider_4 = DoubleSlider(0.3, range=-3..3 step 0.1)
number_slider_5 = DoubleSlider(0.1, range=0..2 step 0.1)

# group: Deck remodeling
boolean = BoolSelector(false)
byPoints = PolyCurve.ByPoints(points=slice, connectLastToFirst=boolean)
startPoint = Curve.StartPoint(curve=byBestFitThroughPoints)
byOriginNormal = Plane.ByOriginNormal(origin=pointAtParameter, normal=direction)
byWidthLength = Rectangle.ByWidthLength(plane=byOriginNormal, width=number_slider_2, length=number_slider_3)
translate = Geometry.Translate(geometry=byWidthLength, xTranslation=number_slider_4, yTranslation=number_slider_5)
sweepAsSolid = Curve.SweepAsSolid(curve=translate, path=byBestFitThroughPoints)
color_palette = ColorPalette({R: 255, G: 136, B: 53, A: 255})
byGeometryColor = Modifiers.GeometryColor.ByGeometryColor(geometry=sweepAsSolid, color=color_palette)

# group: Load mesh geometries
file_path_2 = Filename("..\geometryFiles\LoD200\pathway.off")
loadOffGeometry = IfcInfraToolKit_DynamoCore.MeshImporter.LoadOffGeometry(offFilePath=file_path_2)
toDynamoPatches = IfcInfraToolKit_DynamoCore.MeshImporter.ToDynamoPatches(geometry=loadOffGeometry)
byJoinedSurfaces = Solid.ByJoinedSurfaces(facesOfSolid=toDynamoPatches)
file_path_3 = Filename("..\geometryFiles\LoD200\handrail_2.off")
loadOffGeometry_2 = IfcInfraToolKit_DynamoCore.MeshImporter.LoadOffGeometry(offFilePath=file_path_3)
toDynamoPatches_2 = IfcInfraToolKit_DynamoCore.MeshImporter.ToDynamoPatches(geometry=loadOffGeometry_2)
byJoinedSurfaces_2 = Solid.ByJoinedSurfaces(facesOfSolid=toDynamoPatches_2)
file_path_4 = Filename("..\geometryFiles\LoD200\handrail_1.off")
loadOffGeometry_3 = IfcInfraToolKit_DynamoCore.MeshImporter.LoadOffGeometry(offFilePath=file_path_4)
toDynamoPatches_3 = IfcInfraToolKit_DynamoCore.MeshImporter.ToDynamoPatches(geometry=loadOffGeometry_3)
byJoinedSurfaces_3 = Solid.ByJoinedSurfaces(facesOfSolid=toDynamoPatches_3)

color_palette_2 = ColorPalette({R: 0, G: 255, B: 255, A: 255})
byGeometryColor_2 = Modifiers.GeometryColor.ByGeometryColor(geometry=byJoinedSurfaces, color=color_palette_2)

# group: Init and save the IFC model
code_block_2 = CodeBlock { "bridge"; "bridgeSite"; }
createIfcModel = IfcInfraToolKit_DynamoCore.IfcModelSetup.CreateIfcModel(projectName=code_block_2.out0, siteName=code_block_2.out1)
directory_path = Directory("C:\Users\Sebastian Esser\Desktop")
code_block_3 = CodeBlock { "remodeledBridge"; }

code_block_4 = CodeBlock { "null"; }

# group: Export remodeled deck
getGeometryInformation = IfcInfraToolKit_DynamoCore.DynamoGeometryExporter.GetGeometryInformation(solidGeometry=sweepAsSolid, databaseContainer=createIfcModel, productGuid=code_block_4)  # frozen

# group: Export left handrail
getGeometryInformation_2 = IfcInfraToolKit_DynamoCore.DynamoGeometryExporter.GetGeometryInformation(solidGeometry=byJoinedSurfaces_3, databaseContainer=getGeometryInformation.DatabaseContainer, productGuid=code_block_4)  # frozen

# group: Export right handrail
getGeometryInformation_3 = IfcInfraToolKit_DynamoCore.DynamoGeometryExporter.GetGeometryInformation(solidGeometry=byJoinedSurfaces_2, databaseContainer=getGeometryInformation_2.DatabaseContainer, productGuid=code_block_4)  # frozen

# group (continued): Init and save the IFC model
saveIfcModel = IfcInfraToolKit_DynamoCore.IfcModelSetup.SaveIfcModel(container=getGeometryInformation_3.DatabaseContainer, path=directory_path, modelName=code_block_3)
