# Dynamo graph JoinOffGeoms_Revit.dyn (Dynamo 2.6.1.8786)

file_path = Filename("C:\dev\ifcinfratoolkit\sampleDymamoScripts\geometryFiles\LoD200\vault_1.off")
loadOffGeometry = IfcInfraToolKit_DynamoCore.MeshImporter.LoadOffGeometry(offFilePath=file_path)
file_path_2 = Filename("C:\dev\ifcinfratoolkit\sampleDymamoScripts\geometryFiles\LoD200\vault_2.off")
loadOffGeometry_2 = IfcInfraToolKit_DynamoCore.MeshImporter.LoadOffGeometry(offFilePath=file_path_2)
list_create = List.Create(item0=loadOffGeometry, item1=loadOffGeometry_2)
flatten = List.Flatten(list=list_create)
joinOffGeometries = IfcInfraToolKit_DynamoCore.MeshImporter.JoinOffGeometries(geometries=flatten)
toDynamoPatches = IfcInfraToolKit_DynamoCore.MeshImporter.ToDynamoPatches(geometry=joinOffGeometries)
byJoinedSurfaces = Solid.ByJoinedSurfaces(facesOfSolid=toDynamoPatches)
