# Dynamo graph AppendProperty.dyn (Dynamo 2.8.0.2471)

createIfcModel = IfcInfraToolKit_DynamoCore.IfcModelSetup.CreateIfcModel()
code_block = CodeBlock { "null"; "SampleFacility_withProperty"; }
addFacility = IfcInfraToolKit_DynamoCore.IfcModelSetup.AddFacility(databaseContainer=createIfcModel, hostGuid=code_block.out0, facilityName=code_block.out1)

# group: property names and values
code_block_2 = CodeBlock { "property1"; "valueA"; }
code_block_3 = CodeBlock { "property2"; "valueB"; }

# group: Create single text properties
createIfcTextProperty = IfcInfraToolKit_DynamoCore.IfcPropertyManager.CreateIfcTextProperty(databaseContainer=addFacility.DatabaseContainer, pName=code_block_2.out0, pValue=code_block_2.out1)
createIfcTextProperty_2 = IfcInfraToolKit_DynamoCore.IfcPropertyManager.CreateIfcTextProperty(databaseContainer=createIfcTextProperty.DatabaseContainer, pName=code_block_3.out0, pValue=code_block_3.out1)

# group: PSet Name
code_block_4 = CodeBlock { "SamplePSet"; }

list_create = List.Create(item0=createIfcTextProperty.IfcTextProperty, item1=createIfcTextProperty_2.IfcTextProperty)

# group: Create PropertySet and assign properties
appendPropertySet = IfcInfraToolKit_DynamoCore.IfcPropertyManager.AppendPropertySet(databaseContainer=createIfcTextProperty_2.DatabaseContainer, hostGuid=addFacility.FacilityGUID, PSetName=code_block_4, ifcProperties=list_create)

directory_path = Directory("C:\Users\Sebastian Esser\Desktop")
code_block_5 = CodeBlock { "model_with_property"; }
saveIfcModel = IfcInfraToolKit_DynamoCore.IfcModelSetup.SaveIfcModel(container=appendPropertySet, path=directory_path, modelName=code_block_5)
