# Dynamo graph FloresBridge2.dyn (Dynamo 2.5.0.7460)

# group: Get all bridge elements from revit model
element_types = ElementTypes("DirectShape")
all_elements_of_type = ElementsOfType(element_type=element_types)

# group: Extract Solid data and remove empty lists
solids = Element.Solids(element=all_elements_of_type)
type = Object.Type(obj=solids)
code_block = CodeBlock { "Solid"; }
contains = String.Contains(str=type, searchFor=code_block)
filterByBoolMask = List.FilterByBoolMask(list=solids, mask=contains)
flatten = List.Flatten(list=filterByBoolMask.in)

# group: Extract Mesh data (Assumed to be Light and guardrails)
geometry = Element.Geometry(element=all_elements_of_type)
type_2 = Object.Type(obj=geometry)
code_block_2 = CodeBlock { "Mesh"; }
contains_2 = String.Contains(str=type_2, searchFor=code_block_2)
filterByBoolMask_2 = List.FilterByBoolMask(list=geometry, mask=contains_2)
flatten_2 = List.Flatten(list=filterByBoolMask_2.in)

# group: Create Ifc Model
code_block_3 = CodeBlock { "FloresBridge"; }
createIfcModel = IfcInfraToolKit_DynamoCore.IfcModelSetup.CreateIfcModel(projectName=code_block_3)
code_block_4 = CodeBlock { null; }
code_block_5 = CodeBlock { "IfcBuildingElementProxy"; }

code_block_6 = CodeBlock { "IfcRailing"; }

# group: add Mesh and Solid data to database
exportMeshGeometryAsBRep = IfcInfraToolKit_DynamoCore.DynamoGeometryExporter.ExportMeshGeometryAsBRep(meshGeometry=flatten_2, databaseContainer=createIfcModel, productGuid=code_block_4, buildingElementType=code_block_6)
exportSolidGeometryAsBRep = IfcInfraToolKit_DynamoCore.DynamoGeometryExporter.ExportSolidGeometryAsBRep(solidGeometry=flatten, databaseContainer=exportMeshGeometryAsBRep.DatabaseContainer, productGuid=code_block_4, buildingElementType=code_block_5)

# group: Store data in IFC file and watch IFC
watchIFC = IfcInfraToolKit_DynamoCore.IfcModelSetup.WatchIFC(databaseContainer=exportSolidGeometryAsBRep.DatabaseContainer)
directory_path = Directory("C:\Users\janin\OneDrive\Dokumente\HiwiCMS\IfcInfraToolkit\RevitTests")
code_block_7 = CodeBlock { "FloresBridge2"; }
saveIfcModel = IfcInfraToolKit_DynamoCore.IfcModelSetup.SaveIfcModel(container=exportSolidGeometryAsBRep.DatabaseContainer, path=directory_path, modelName=code_block_7)
