# Dynamo graph FloresBridge2.dyn (Dynamo 2.5.0.7460)
# packages: MeshToolkit 3.0.0

# group: Get all bridge elements from revit model
element_types = ElementTypes("DirectShape")
all_elements_of_type = ElementsOfType(element_type=element_types)

# group: Extract all Solid Parts (Main structure of bridge)
solids = Element.Solids(element=all_elements_of_type)

# group: Create and add data to Ifc File
code_block = CodeBlock { "FloresBridge"; }
createIfcModel = IfcInfraToolKit_DynamoCore.IfcModelSetup.CreateIfcModel(projectName=code_block)
code_block_2 = CodeBlock { null; }
code_block_3 = CodeBlock { "IfcBuildingElementProxy"; }
exportSolidGeometryAsBRep = IfcInfraToolKit_DynamoCore.DynamoGeometryExporter.ExportSolidGeometryAsBRep(solidGeometry=solids, databaseContainer=createIfcModel, productGuid=code_block_2, buildingElementType=code_block_3)
watchIFC = IfcInfraToolKit_DynamoCore.IfcModelSetup.WatchIFC(databaseContainer=exportSolidGeometryAsBRep.DatabaseContainer)
directory_path = Directory("C:\Users\janin\OneDrive\Dokumente\HiwiCMS\IfcInfraToolkit\RevitTests")
code_block_4 = CodeBlock { "FloresBridge2"; }
saveIfcModel = IfcInfraToolKit_DynamoCore.IfcModelSetup.SaveIfcModel(container=exportSolidGeometryAsBRep.DatabaseContainer, path=directory_path, modelName=code_block_4)

# group: Extract Mesh data (Assumed to be Light and guardrails)
geometry = Element.Geometry(element=all_elements_of_type)
type = Object.Type(obj=geometry)
code_block_5 = CodeBlock { "Mesh"; }
contains = String.Contains(str=type, searchFor=code_block_5)
filterByBoolMask = List.FilterByBoolMask(list=geometry, mask=contains)
flatten = List.Flatten(list=filterByBoolMask.in)

code_block_6 = CodeBlock { 27; }
getItemAtIndex = List.GetItemAtIndex(list=flatten, index=code_block_6)
vertexPositions = Mesh.VertexPositions(mesh=getItemAtIndex)
vertexPositions_2 = Mesh.VertexPositions(mesh=flatten)
byVerticesAndIndices = Autodesk.Dynamo.MeshToolkit.Mesh.ByVerticesAndIndices(vertices=vertexPositions_2)  # unwired: indices
repair = Autodesk.Dynamo.MeshToolkit.Mesh.Repair(mesh=flatten)
faceIndices = Mesh.FaceIndices(mesh=getItemAtIndex)
byControlPoints = NurbsSurface.ByControlPoints(controlVertices=faceIndices)
