# Dynamo graph CreateAndStoreIFC.dyn (Dynamo 2.8.0.2471)

createIfcModel = IfcInfraToolKit_DynamoCore.IfcModelSetup.CreateIfcModel()
directory_path = Directory("C:\dev")
code_block = CodeBlock { "mySampleModel"; }
saveIfcModel = IfcInfraToolKit_DynamoCore.IfcModelSetup.SaveIfcModel(container=createIfcModel, path=directory_path, modelName=code_block)
