# Dynamo graph CreateMeshedSphere.dyn (Dynamo 2.8.0.2471)
# packages: MeshToolkit 3.0.0

createIfcModel = IfcInfraToolKit_DynamoCore.IfcModelSetup.CreateIfcModel()
addFacility = IfcInfraToolKit_DynamoCore.IfcModelSetup.AddFacility(databaseContainer=createIfcModel)
code_block = CodeBlock { "null"; }
code_block_2 = CodeBlock { "IfcBuildingElementProxy"; }
exportMeshGeometryAsBRep = IfcInfraToolKit_DynamoCore.DynamoGeometryExporter.ExportMeshGeometryAsBRep(databaseContainer=addFacility.DatabaseContainer, parentGuid=code_block, buildingElementType=code_block_2)  # unwired: meshGeometry
directory_path = Directory("C:\Users\Sebastian Esser\Desktop")
code_block_3 = CodeBlock { "meshedSphere.ifc"; }
saveIfcModel = IfcInfraToolKit_DynamoCore.IfcModelSetup.SaveIfcModel(container=exportMeshGeometryAsBRep.DatabaseContainer, path=directory_path, modelName=code_block_3)
code_block_4 = CodeBlock { 2; }
code_block_5 = CodeBlock { 5; }
byRadiusHeight = Cylinder.ByRadiusHeight(radius=code_block_4, height=code_block_5)
byGeometry = Autodesk.Dynamo.MeshToolkit.Mesh.ByGeometry(inputGeometry=byRadiusHeight)
code_block_6 = CodeBlock()  # // mesh ist nicht gleich Mesh
