# Dynamo graph CreateSpatialStructure.dyn (Dynamo 2.8.0.2471)

# group: User Input
code_block = CodeBlock { "null"; "SampleFacility"; }
code_block_2 = CodeBlock { "SamplePart"; }
directory_path = Directory("C:\Users\Sebastian Esser\Desktop")
code_block_3 = CodeBlock { "spatial_updated"; }

# group: IFC interaction
createIfcModel = IfcInfraToolKit_DynamoCore.IfcModelSetup.CreateIfcModel()
addFacility = IfcInfraToolKit_DynamoCore.IfcModelSetup.AddFacility(databaseContainer=createIfcModel, hostGuid=code_block.out0, facilityName=code_block.out1)

watch = Watch(addFacility.FacilityGUID)

# group (continued): IFC interaction
addFacilityPart = IfcInfraToolKit_DynamoCore.IfcModelSetup.AddFacilityPart(databaseContainer=addFacility.DatabaseContainer, hostGuid=watch, facilityPartName=code_block_2)
saveIfcModel = IfcInfraToolKit_DynamoCore.IfcModelSetup.SaveIfcModel(container=addFacilityPart.DatabaseContainer, path=directory_path, modelName=code_block_3)

watch_2 = Watch(addFacilityPart.FacilityPartGUID)
