# Dynamo graph CreateSpatialStructure_FacilityPartPDT.dyn (Dynamo 2.10.0.3455)

createIfcModel = IfcInfraToolKit_DynamoCore.IfcModelSetup.CreateIfcModel()
addFacility = IfcInfraToolKit_DynamoCore.SpatialStructureDesigner.AddFacility(databaseContainer=createIfcModel)
code_block = CodeBlock { "null"; }
code_block_2 = CodeBlock { "my Bridge"; }
addBridge = IfcInfraToolKit_DynamoCore.SpatialStructureDesigner.AddBridge(databaseContainer=addFacility.DatabaseContainer, hostGuid=code_block, bridgeName=code_block_2)
code_block_3 = CodeBlock { "my Road"; }
addRoad = IfcInfraToolKit_DynamoCore.SpatialStructureDesigner.AddRoad(databaseContainer=addBridge.DatabaseContainer, hostGuid=code_block, roadName=code_block_3)
getSpatialStructureItems = IfcInfraToolKit_DynamoCore.IfcModelSetup.GetSpatialStructureItems(databaseContainer=addRoad.DatabaseContainer)

# group: Check Ifc content
watch = Watch(getSpatialStructureItems.IfcClasses)
watch_2 = Watch(getSpatialStructureItems.PredefinedTypes)

getAvailableFacilityPartTypes = IfcInfraToolKit_DynamoCore.SpatialStructureDesigner.GetAvailableFacilityPartTypes()

# group: IFC content
code_block_4 = CodeBlock { "TestFacilityPart"; }

getPredefinedFacilityPartUsage = IfcInfraToolKit_DynamoCore.SpatialStructureDesigner.GetPredefinedFacilityPartUsage()

# group: PredefinedType of IfcFacilityPart
watch_3 = Watch(getAvailableFacilityPartTypes)
code_block_5 = CodeBlock(list=watch_3) { list[1]; }
code_block_6 = CodeBlock(list=getPredefinedFacilityPartUsage) { list[2]; }

getPredefinedType = IfcInfraToolKit_DynamoCore.SpatialStructureDesigner.GetPredefinedType(facilityPartEnum=code_block_5)

# group (continued): PredefinedType of IfcFacilityPart
code_block_7 = CodeBlock(list=getPredefinedType) { list[5]; }

watch_4 = Watch(code_block_7)
watch_5 = Watch(code_block_5)
addFacilityPart = IfcInfraToolKit_DynamoCore.SpatialStructureDesigner.AddFacilityPart(databaseContainer=addFacility.DatabaseContainer, hostGuid=addFacility.FacilityGUID, name=code_block_4, facilityType=code_block_5, facilityPartType=code_block_7, usageType=code_block_6)
