# Dynamo graph CreateSpatialStructure_Road.dyn (Dynamo 2.8.0.2471)

createIfcModel = IfcInfraToolKit_DynamoCore.IfcModelSetup.CreateIfcModel()
code_block = CodeBlock { "null"; "SampleFacility"; }
addFacility = IfcInfraToolKit_DynamoCore.IfcModelSetup.AddFacility(databaseContainer=createIfcModel, hostGuid=code_block.out0, facilityName=code_block.out1)
watch = Watch(addFacility.FacilityGUID)
code_block_2 = CodeBlock { "SamplePart"; }
addFacilityPart = IfcInfraToolKit_DynamoCore.IfcModelSetup.AddFacilityPart(databaseContainer=addFacility.DatabaseContainer, hostGuid=watch, facilityPartName=code_block_2)
watch_2 = Watch(addFacilityPart.FacilityPartGUID)
IFCAddRoad = IfcInfraToolkit_Dyn.Road.IFCAddRoad(databaseContainer=addFacilityPart.DatabaseContainer, hostGuid=watch_2)
directory_path = Directory("C:\Users\Sebastian Esser\Desktop")
code_block_3 = CodeBlock { "blub"; }
saveIfcModel = IfcInfraToolKit_DynamoCore.IfcModelSetup.SaveIfcModel(container=IFCAddRoad.DatabaseContainer, path=directory_path, modelName=code_block_3)
