# Dynamo graph GetAllIfcElements.dyn (Dynamo 2.10.0.3455)

file_path = Filename("C:\Users\Sebastian Esser\Desktop\f-bru_enriched_testing_export_select.ifc")
openIfcModel = IfcInfraToolKit_DynamoCore.IfcModelSetup.OpenIfcModel(path=file_path)
getElementItems = IfcInfraToolKit_DynamoCore.IfcModelSetup.GetElementItems(databaseContainer=openIfcModel)
watch = Watch(getElementItems.GUIDs)
watch_2 = Watch(getElementItems.Names)
watch_3 = Watch(getElementItems.IfcClasses)
watch_4 = Watch(getElementItems.PredefinedTypes)
