# Dynamo graph JoinOffGeometries.dyn (Dynamo 2.8.0.2471)

file_path = Filename("..\geometryFiles\LoD200\vault_1.off")
loadOffGeometry = IfcInfraToolKit_DynamoCore.MeshImporter.LoadOffGeometry(offFilePath=file_path)
file_path_2 = Filename("..\geometryFiles\LoD200\vault_2.off")
loadOffGeometry_2 = IfcInfraToolKit_DynamoCore.MeshImporter.LoadOffGeometry(offFilePath=file_path_2)
list_create = List.Create(item0=loadOffGeometry, item1=loadOffGeometry_2)
flatten = List.Flatten(list=list_create)
joinOffGeometries = IfcInfraToolKit_DynamoCore.MeshImporter.JoinOffGeometries(geometries=flatten)
