# Dynamo graph ObserveIfcContent.dyn (Dynamo 2.10.0.3455)

# group: Open IFC model
file_path = Filename("C:\Users\Sebastian Esser\Desktop\f-bru_enriched_testing_export_select.ifc")
openIfcModel = IfcInfraToolKit_DynamoCore.IfcModelSetup.OpenIfcModel(path=file_path)

# group: SpatialStructure items
getSpatialStructureItems = IfcInfraToolKit_DynamoCore.IfcModelSetup.GetSpatialStructureItems(databaseContainer=openIfcModel)
watch = Watch(getSpatialStructureItems.GUIDs)
watch_2 = Watch(getSpatialStructureItems.Names)
watch_3 = Watch(getSpatialStructureItems.IfcClasses)
watch_4 = Watch(getSpatialStructureItems.PredefinedTypes)

# group: ObjectDefinition items
getObjectDefinitionItems = IfcInfraToolKit_DynamoCore.IfcModelSetup.GetObjectDefinitionItems(databaseContainer=openIfcModel)
watch_5 = Watch(getObjectDefinitionItems.IfcClasses)
watch_6 = Watch(getObjectDefinitionItems.Names)
watch_7 = Watch(getObjectDefinitionItems.GUIDs)
