# Dynamo graph OpenExistingModel.dyn (Dynamo 2.10.0.3455)

file_path = Filename("C:\dev\IFCSampleFiles\LevelCrossing\LevelCrossing_MockUp_IFC2x3\TUMCMS_LevelCrossing_MockUp 2x3.ifc")
openIfcModel = IfcInfraToolKit_DynamoCore.IfcModelSetup.OpenIfcModel(path=file_path)
getObjectDefinitionItems = IfcInfraToolKit_DynamoCore.IfcModelSetup.GetObjectDefinitionItems(databaseContainer=openIfcModel)
getSpatialStructureItems = IfcInfraToolKit_DynamoCore.IfcModelSetup.GetSpatialStructureItems(databaseContainer=openIfcModel)
getElementItems = IfcInfraToolKit_DynamoCore.IfcModelSetup.GetElementItems(databaseContainer=openIfcModel)
watch = Watch(getElementItems.IfcClasses)
watch_2 = Watch(getElementItems.Names)
