# Dynamo graph cuboidBridge.dyn (Dynamo 2.10.0.3455)

code_block = CodeBlock { 0.2; 12; 7; }
byLengths = Cuboid.ByLengths(width=code_block.out2, length=code_block.out1, height=code_block.out0)
code_block_2 = CodeBlock { 5; }
code_block_3 = CodeBlock { 2.1; }
translate = Geometry.Translate(geometry=byLengths, yTranslation=code_block_2, zTranslation=code_block_3)
code_block_4 = CodeBlock { 6; 0.8; 4; }
byLengths_2 = Cuboid.ByLengths(width=code_block_4.out0, length=code_block_4.out1, height=code_block_4.out2)
code_block_5 = CodeBlock { 10; }
translate_2 = Geometry.Translate(geometry=byLengths_2, yTranslation=code_block_5)
code_block_6 = CodeBlock { 6; 0.8; 4; }
byLengths_3 = Cuboid.ByLengths(width=code_block_6.out0, length=code_block_6.out1, height=code_block_6.out2)
createIfcModel = IfcInfraToolKit_DynamoCore.IfcModelSetup.CreateIfcModel()
code_block_7 = CodeBlock { "null"; }
code_block_8 = CodeBlock { "IfcBeam"; }
exportSolidGeometryAsBRep = IfcInfraToolKit_DynamoCore.DynamoGeometryExporter.ExportSolidGeometryAsBRep(solidGeometry=byLengths_3, databaseContainer=createIfcModel, parentGuid=code_block_7, buildingElementType=code_block_8)
code_block_9 = CodeBlock { "IfcWall"; }
exportSolidGeometryAsBRep_2 = IfcInfraToolKit_DynamoCore.DynamoGeometryExporter.ExportSolidGeometryAsBRep(solidGeometry=translate_2, databaseContainer=exportSolidGeometryAsBRep.DatabaseContainer, parentGuid=code_block_7, buildingElementType=code_block_9)
code_block_10 = CodeBlock { "IfcBearing"; }
exportSolidGeometryAsBRep_3 = IfcInfraToolKit_DynamoCore.DynamoGeometryExporter.ExportSolidGeometryAsBRep(solidGeometry=translate, databaseContainer=exportSolidGeometryAsBRep_2.DatabaseContainer, parentGuid=code_block_7, buildingElementType=code_block_10)

# group: Add Facility Part semantics
addFacility = IfcInfraToolKit_DynamoCore.SpatialStructureDesigner.AddFacility(databaseContainer=exportSolidGeometryAsBRep_3.DatabaseContainer)
code_block_11 = CodeBlock { "IfcBridgePartTypeEnum"; }
code_block_12 = CodeBlock { "PIER"; }
code_block_13 = CodeBlock { "NiceTestingPier"; }
addFacilityPart = IfcInfraToolKit_DynamoCore.SpatialStructureDesigner.AddFacilityPart(databaseContainer=addFacility.DatabaseContainer, hostGuid=addFacility.FacilityGUID, facilityType=code_block_11, facilityPartType=code_block_12, facilityPartName=code_block_13)

directory_path = Directory("C:\Users\janin\OneDrive\Dokumente\HiwiCMS\IfcInfraToolkit")
code_block_14 = CodeBlock { "cuboidBridge"; }
saveIfcModel = IfcInfraToolKit_DynamoCore.IfcModelSetup.SaveIfcModel(container=addFacilityPart.DatabaseContainer, path=directory_path, modelName=code_block_14)
