# Dynamo graph simpleGeometryExport.dyn (Dynamo 2.10.0.3455)

# group: User Input
code_block = CodeBlock { 10; 50; 200; }
byLengths = Cuboid.ByLengths(width=code_block.out0, length=code_block.out1, height=code_block.out2)
code_block_2 = CodeBlock { "IfcWall"; "Element01"; }
directory_path = Directory("C:\Users\Sebastian Esser\Desktop")
code_block_3 = CodeBlock { "cuboid"; }

# group: IFC model generation
code_block_4 = CodeBlock { "null"; }
createIfcModel = IfcInfraToolKit_DynamoCore.IfcModelSetup.CreateIfcModel(projectName=code_block_4, siteName=code_block_4)
code_block_5 = CodeBlock { "null"; }
addElement = IfcInfraToolKit_DynamoCore.ElementDesigner.AddElement(databaseContainer=createIfcModel, IfcClass=code_block_2.out0, elementName=code_block_2.out1, hostGuid=code_block_5)
addSolidGeometryAsBRep = IfcInfraToolKit_DynamoCore.DynamoGeometryExporter.AddSolidGeometryAsBRep(solidGeometry=byLengths, databaseContainer=addElement.DatabaseContainer, elementGuid=addElement.ElementGUID)
saveIfcModel = IfcInfraToolKit_DynamoCore.IfcModelSetup.SaveIfcModel(container=addSolidGeometryAsBRep.DatabaseContainer, path=directory_path, modelName=code_block_3)

# group: Observe IFC model content
getObjectDefinitionItems = IfcInfraToolKit_DynamoCore.IfcModelSetup.GetObjectDefinitionItems(databaseContainer=addElement.DatabaseContainer)
watch = Watch(getObjectDefinitionItems.IfcClasses)
watch_2 = Watch(addElement.ElementGUID)
watch_3 = Watch(getObjectDefinitionItems.GUIDs)
getObjectDefinitionItems_2 = IfcInfraToolKit_DynamoCore.IfcModelSetup.GetObjectDefinitionItems(databaseContainer=createIfcModel)
watch_4 = Watch(getObjectDefinitionItems_2.IfcClasses)
watch_5 = Watch(getObjectDefinitionItems_2.GUIDs)
