# Dynamo graph HelloIFCWorld.dyn (Dynamo 2.5.2.7915)

code_block = CodeBlock { "Esser"; "Sebastian"; "TUMCMS/Autodesk"; }
IFC_root = IfcInfraToolkit_Dyn.IFC_root.IFC_root(familyName=code_block.out0, firstName=code_block.out1, organization=code_block.out2)
code_block_2 = CodeBlock { "myFirstIfc4x3Model"; }
directory_path = Directory("C:\dev")
IFC_export = IfcInfraToolkit_Dyn.IFC_root.IFC_export(iFC_root=IFC_root, modelName=code_block_2, filepath=directory_path)
