# Dynamo graph PTworkflow.dyn (Dynamo 2.6.1.8786)

# group: Piers
file_path = Filename("geometryFiles\LoD200\pier_1.off")
loadOffGeometry = IfcInfraToolKit_DynamoCore.MeshImporter.LoadOffGeometry(offFilePath=file_path)
file_path_2 = Filename("geometryFiles\LoD200\pier_2.off")
loadOffGeometry_2 = IfcInfraToolKit_DynamoCore.MeshImporter.LoadOffGeometry(offFilePath=file_path_2)
file_path_3 = Filename("geometryFiles\LoD200\pier_3.off")
loadOffGeometry_3 = IfcInfraToolKit_DynamoCore.MeshImporter.LoadOffGeometry(offFilePath=file_path_3)
file_path_4 = Filename("geometryFiles\LoD200\pier_4.off")
loadOffGeometry_4 = IfcInfraToolKit_DynamoCore.MeshImporter.LoadOffGeometry(offFilePath=file_path_4)

list_create = List.Create(item0=loadOffGeometry, item1=loadOffGeometry_2, item2=loadOffGeometry_3, item3=loadOffGeometry_4)
toDynamoPatches = IfcInfraToolKit_DynamoCore.MeshImporter.ToDynamoPatches(geometry=list_create)
byJoinedSurfaces = Solid.ByJoinedSurfaces(facesOfSolid=toDynamoPatches)
categories = Categories("OST_GenericModel")
byGeometry = DirectShape.ByGeometry(geometry=byJoinedSurfaces, category=categories)  # frozen

# group: Cutwater
file_path_5 = Filename("geometryFiles\LoD200\cutwater_1.off")
loadOffGeometry_5 = IfcInfraToolKit_DynamoCore.MeshImporter.LoadOffGeometry(offFilePath=file_path_5)
file_path_6 = Filename("geometryFiles\LoD200\cutwater_2.off")
loadOffGeometry_6 = IfcInfraToolKit_DynamoCore.MeshImporter.LoadOffGeometry(offFilePath=file_path_6)
file_path_7 = Filename("geometryFiles\LoD200\cutwater_3.off")
loadOffGeometry_7 = IfcInfraToolKit_DynamoCore.MeshImporter.LoadOffGeometry(offFilePath=file_path_7)
file_path_8 = Filename("geometryFiles\LoD200\cutwater_4.off")
loadOffGeometry_8 = IfcInfraToolKit_DynamoCore.MeshImporter.LoadOffGeometry(offFilePath=file_path_8)

list_create_2 = List.Create(item0=loadOffGeometry_5, item1=loadOffGeometry_6, item2=loadOffGeometry_7, item3=loadOffGeometry_8)
toDynamoPatches_2 = IfcInfraToolKit_DynamoCore.MeshImporter.ToDynamoPatches(geometry=list_create_2)
byJoinedSurfaces_2 = Solid.ByJoinedSurfaces(facesOfSolid=toDynamoPatches_2)
categories_2 = Categories("OST_GenericModel")
byGeometry_2 = DirectShape.ByGeometry(geometry=byJoinedSurfaces_2, category=categories_2)  # frozen

# group: Pathway
file_path_9 = Filename("geometryFiles\LoD200\pathway.off")
loadOffGeometry_9 = IfcInfraToolKit_DynamoCore.MeshImporter.LoadOffGeometry(offFilePath=file_path_9)

list_create_3 = List.Create(item0=loadOffGeometry_9)
toDynamoPatches_3 = IfcInfraToolKit_DynamoCore.MeshImporter.ToDynamoPatches(geometry=list_create_3)
byJoinedSurfaces_3 = Solid.ByJoinedSurfaces(facesOfSolid=toDynamoPatches_3)
categories_3 = Categories("OST_GenericModel")
byGeometry_3 = DirectShape.ByGeometry(geometry=byJoinedSurfaces_3, category=categories_3)  # frozen

# group: Handrail
file_path_10 = Filename("geometryFiles\LoD200\handrail_1.off")
loadOffGeometry_10 = IfcInfraToolKit_DynamoCore.MeshImporter.LoadOffGeometry(offFilePath=file_path_10)
file_path_11 = Filename("geometryFiles\LoD200\handrail_2.off")
loadOffGeometry_11 = IfcInfraToolKit_DynamoCore.MeshImporter.LoadOffGeometry(offFilePath=file_path_11)

list_create_4 = List.Create(item0=loadOffGeometry_10, item1=loadOffGeometry_11)
toDynamoPatches_4 = IfcInfraToolKit_DynamoCore.MeshImporter.ToDynamoPatches(geometry=list_create_4)
byJoinedSurfaces_4 = Solid.ByJoinedSurfaces(facesOfSolid=toDynamoPatches_4)
categories_4 = Categories("OST_StairsRailing")
byGeometry_4 = DirectShape.ByGeometry(geometry=byJoinedSurfaces_4, category=categories_4)  # frozen

# group: Vault
file_path_12 = Filename("geometryFiles\LoD200\vault_1.off")
loadOffGeometry_12 = IfcInfraToolKit_DynamoCore.MeshImporter.LoadOffGeometry(offFilePath=file_path_12)
file_path_13 = Filename("geometryFiles\LoD200\vault_2.off")
loadOffGeometry_13 = IfcInfraToolKit_DynamoCore.MeshImporter.LoadOffGeometry(offFilePath=file_path_13)

file_path_14 = Filename("geometryFiles\LoD200\vault_4.off")
loadOffGeometry_14 = IfcInfraToolKit_DynamoCore.MeshImporter.LoadOffGeometry(offFilePath=file_path_14)
file_path_15 = Filename("geometryFiles\LoD200\vault_5.off")
loadOffGeometry_15 = IfcInfraToolKit_DynamoCore.MeshImporter.LoadOffGeometry(offFilePath=file_path_15)
file_path_16 = Filename("geometryFiles\LoD200\vault_3.off")
loadOffGeometry_16 = IfcInfraToolKit_DynamoCore.MeshImporter.LoadOffGeometry(offFilePath=file_path_16)
file_path_17 = Filename("geometryFiles\LoD200\spandrel_wall_1.off")
loadOffGeometry_17 = IfcInfraToolKit_DynamoCore.MeshImporter.LoadOffGeometry(offFilePath=file_path_17)
toDynamoPatches_5 = IfcInfraToolKit_DynamoCore.MeshImporter.ToDynamoPatches(geometry=loadOffGeometry_17)
byJoinedSurfaces_5 = Solid.ByJoinedSurfaces(facesOfSolid=toDynamoPatches_5)
file_path_18 = Filename("geometryFiles\LoD200\spandrel_wall_2.off")
loadOffGeometry_18 = IfcInfraToolKit_DynamoCore.MeshImporter.LoadOffGeometry(offFilePath=file_path_18)
toDynamoPatches_6 = IfcInfraToolKit_DynamoCore.MeshImporter.ToDynamoPatches(geometry=loadOffGeometry_18)
byJoinedSurfaces_6 = Solid.ByJoinedSurfaces(facesOfSolid=toDynamoPatches_6)
list_create_5 = List.Create(item0=byJoinedSurfaces_5, item1=byJoinedSurfaces_6)
byUnion = Solid.ByUnion(solids=list_create_5)
