# Dynamo graph PTworkflow_DynCore.dyn (Dynamo 2.8.0.2471)

# group: Importing Deck
file_path = Filename("geometryFiles\LoD200\pathway.off")
loadOffGeometry = IfcInfraToolKit_DynamoCore.MeshImporter.LoadOffGeometry(offFilePath=file_path)
list_create = List.Create(item0=loadOffGeometry)
toDynamoPatches = IfcInfraToolKit_DynamoCore.MeshImporter.ToDynamoPatches(geometry=list_create)
byJoinedSurfaces = Solid.ByJoinedSurfaces(facesOfSolid=toDynamoPatches)

# group: Importing Handrails
file_path_2 = Filename("geometryFiles\LoD200\handrail_1.off")
loadOffGeometry_2 = IfcInfraToolKit_DynamoCore.MeshImporter.LoadOffGeometry(offFilePath=file_path_2)
file_path_3 = Filename("geometryFiles\LoD200\handrail_2.off")
loadOffGeometry_3 = IfcInfraToolKit_DynamoCore.MeshImporter.LoadOffGeometry(offFilePath=file_path_3)
list_create_2 = List.Create(item0=loadOffGeometry_2, item1=loadOffGeometry_3)
toDynamoPatches_2 = IfcInfraToolKit_DynamoCore.MeshImporter.ToDynamoPatches(geometry=list_create_2)
byJoinedSurfaces_2 = Solid.ByJoinedSurfaces(facesOfSolid=toDynamoPatches_2)

# group: Importing Cutwaters
file_path_4 = Filename("geometryFiles\LoD200\cutwater_1.off")
loadOffGeometry_4 = IfcInfraToolKit_DynamoCore.MeshImporter.LoadOffGeometry(offFilePath=file_path_4)
file_path_5 = Filename("geometryFiles\LoD200\cutwater_2.off")
loadOffGeometry_5 = IfcInfraToolKit_DynamoCore.MeshImporter.LoadOffGeometry(offFilePath=file_path_5)
file_path_6 = Filename("geometryFiles\LoD200\cutwater_3.off")
loadOffGeometry_6 = IfcInfraToolKit_DynamoCore.MeshImporter.LoadOffGeometry(offFilePath=file_path_6)
file_path_7 = Filename("geometryFiles\LoD200\cutwater_4.off")
loadOffGeometry_7 = IfcInfraToolKit_DynamoCore.MeshImporter.LoadOffGeometry(offFilePath=file_path_7)
list_create_3 = List.Create(item0=loadOffGeometry_4, item1=loadOffGeometry_5, item2=loadOffGeometry_6, item3=loadOffGeometry_7)
toDynamoPatches_3 = IfcInfraToolKit_DynamoCore.MeshImporter.ToDynamoPatches(geometry=list_create_3)
byJoinedSurfaces_3 = Solid.ByJoinedSurfaces(facesOfSolid=toDynamoPatches_3)

# group: Importing Piers
file_path_8 = Filename("geometryFiles\LoD200\pier_1.off")
loadOffGeometry_8 = IfcInfraToolKit_DynamoCore.MeshImporter.LoadOffGeometry(offFilePath=file_path_8)
file_path_9 = Filename("geometryFiles\LoD200\pier_2.off")
loadOffGeometry_9 = IfcInfraToolKit_DynamoCore.MeshImporter.LoadOffGeometry(offFilePath=file_path_9)
file_path_10 = Filename("geometryFiles\LoD200\pier_3.off")
loadOffGeometry_10 = IfcInfraToolKit_DynamoCore.MeshImporter.LoadOffGeometry(offFilePath=file_path_10)
file_path_11 = Filename("geometryFiles\LoD200\pier_4.off")
loadOffGeometry_11 = IfcInfraToolKit_DynamoCore.MeshImporter.LoadOffGeometry(offFilePath=file_path_11)
list_create_4 = List.Create(item0=loadOffGeometry_8, item1=loadOffGeometry_9, item2=loadOffGeometry_10, item3=loadOffGeometry_11)
toDynamoPatches_4 = IfcInfraToolKit_DynamoCore.MeshImporter.ToDynamoPatches(geometry=list_create_4)
byJoinedSurfaces_4 = Solid.ByJoinedSurfaces(facesOfSolid=toDynamoPatches_4)

code_block = CodeBlock { "null"; }

# group: IFC setup
createIfcModel = IfcInfraToolKit_DynamoCore.IfcModelSetup.CreateIfcModel()
getGeometryInformation = IfcInfraToolKit_DynamoCore.DynamoGeometryExporter.GetGeometryInformation(solidGeometry=byJoinedSurfaces_4, databaseContainer=createIfcModel, productGuid=code_block)
getGeometryInformation_2 = IfcInfraToolKit_DynamoCore.DynamoGeometryExporter.GetGeometryInformation(solidGeometry=byJoinedSurfaces_3, databaseContainer=getGeometryInformation.DatabaseContainer, productGuid=code_block)
getGeometryInformation_3 = IfcInfraToolKit_DynamoCore.DynamoGeometryExporter.GetGeometryInformation(solidGeometry=byJoinedSurfaces_2, databaseContainer=getGeometryInformation_2.DatabaseContainer, productGuid=code_block)
getGeometryInformation_4 = IfcInfraToolKit_DynamoCore.DynamoGeometryExporter.GetGeometryInformation(solidGeometry=byJoinedSurfaces, databaseContainer=getGeometryInformation_3.DatabaseContainer, productGuid=code_block)
directory_path = Directory("C:\Users\Sebastian Esser\Desktop")
code_block_2 = CodeBlock { "PT_ADVEI_sample"; }
saveIfcModel = IfcInfraToolKit_DynamoCore.IfcModelSetup.SaveIfcModel(container=getGeometryInformation_4.DatabaseContainer, path=directory_path, modelName=code_block_2)
