# Dynamo graph PTworkflow_GetGeomData.dyn (Dynamo 2.8.0.2471)

file_path = Filename("geometryFiles\LoD200\pathway.off")
loadOffGeometry = IfcInfraToolKit_DynamoCore.MeshImporter.LoadOffGeometry(offFilePath=file_path)
list_create = List.Create(item0=loadOffGeometry)
toDynamoPatches = IfcInfraToolKit_DynamoCore.MeshImporter.ToDynamoPatches(geometry=list_create)
byJoinedSurfaces = Solid.ByJoinedSurfaces(facesOfSolid=toDynamoPatches)
code_block = CodeBlock { "null"; }
getGeometryInformation = IfcInfraToolKit_DynamoCore.DynamoGeometryExporter.GetGeometryInformation(solidGeometry=byJoinedSurfaces, productGuid=code_block)  # unwired: databaseContainer
code_block_2 = CodeBlock { 10; 200; }
byRadiusHeight = Cylinder.ByRadiusHeight(radius=code_block_2.out0, height=code_block_2.out1)
createIfcModel = IfcInfraToolKit_DynamoCore.IfcModelSetup.CreateIfcModel()
getGeometryInformation_2 = IfcInfraToolKit_DynamoCore.DynamoGeometryExporter.GetGeometryInformation(solidGeometry=byRadiusHeight, databaseContainer=createIfcModel, productGuid=code_block)
directory_path = Directory("C:\Users\Sebastian Esser\Desktop")
code_block_3 = CodeBlock { "geom3"; }
saveIfcModel = IfcInfraToolKit_DynamoCore.IfcModelSetup.SaveIfcModel(container=getGeometryInformation_2.DatabaseContainer, path=directory_path, modelName=code_block_3)
