# Dynamo graph debug.dyn (Dynamo 2.5.1.7586)

code_block = CodeBlock { "Huber"; "Stefan"; "TUMCMS"; }
IFC_root = IfcInfraToolkit_Dyn.IFC_root.IFC_root(familyName=code_block.out0, firstName=code_block.out1, organization=code_block.out2)
code_block_2 = CodeBlock { "sample_ifc_road"; "D:\\Uni\\Forschungspraktikum_IFC\\"; }
IFC_export = IfcInfraToolkit_Dyn.IFC_root.IFC_export(iFC_root=IFC_root, modelName=code_block_2.out0, filepath=code_block_2.out1)
