# Dynamo graph exporter_ifc.dyn (Dynamo 2.5.1.7586)
# packages: Civil3DToolkit 1.1.6

# group: column title
code_block = CodeBlock { ["Station","Hoehe","Streifenbreitelinks","Streifenbreiterechts","Neigunglinks","Neigungrechts"]; }

# group: Select Alignment
current = Autodesk.AutoCAD.DynamoNodes.Document.Current()
alignments = Alignments(document=current)
integer_slider = IntegerSlider(0, range=0..100 step 1)
alignmentselection = Python(IN[0]=alignments, IN[1]=integer_slider)
# ---------- alignmentselection.python (42 lines) ----------
# Load the Python Standard and DesignScript Libraries
import sys
import clr

# Add Assemblies for AutoCAD and Civil3D
clr.AddReference('AcMgd')
clr.AddReference('AcCoreMgd')
clr.AddReference('AcDbMgd')
clr.AddReference('AecBaseMgd')
clr.AddReference('AecPropDataMgd')
clr.AddReference('AeccDbMgd')

# Import references from AutoCAD
from Autodesk.AutoCAD.Runtime import *
from Autodesk.AutoCAD.ApplicationServices import *
from Autodesk.AutoCAD.EditorInput import *
from Autodesk.AutoCAD.DatabaseServices import *
from Autodesk.AutoCAD.Geometry import *

# Import references from Civil3D
from Autodesk.Civil.ApplicationServices import *
from Autodesk.Civil.DatabaseServices import *

# The inputs to this node will be stored as a list in the IN variables.
dataEnteringNode = IN

adoc = Application.DocumentManager.MdiActiveDocument
editor = adoc.Editor

with adoc.LockDocument():
    with adoc.Database as db:

        with db.TransactionManager.StartTransaction() as t:
            # Place your code below
            # 
            #
            # Commit before end transaction
            #t.Commit()
            pass

# Assign your output to the OUT variable.
OUT = IN[0][IN[1]];
# ----------------------------------------

# group: Select Road
corridors = Corridors(document=current)
integer_slider_2 = IntegerSlider(0, range=0..100 step 1)
roadselection = Python(IN[0]=corridors, IN[1]=integer_slider_2)  # same code as alignmentselection

baselines = Autodesk.Civil.DynamoNodes.Corridor.Baselines(corridor=roadselection)
regions = Autodesk.Civil.DynamoNodes.Baseline.Regions(baseline=baselines)
stations = Autodesk.Civil.DynamoNodes.BaselineRegion.Stations(baselineRegion=regions)
flatten = List.Flatten(list=stations)
elevationByStation = Autodesk.Civil.DynamoNodes.Baseline.ElevationByStation(baseline=baselines, station=stations)
flatten_2 = List.Flatten(list=elevationByStation)
subassembliesByStation = Autodesk.Civil.DynamoNodes.Baseline.SubassembliesByStation(baseline=baselines, station=stations)
name = Autodesk.Civil.DynamoNodes.AppliedSubassembly.Name(appliedSubassembly=subassembliesByStation)
code_block_2 = CodeBlock { "LaneSuperelevationAOR - (Right)"; }
eq = name == code_block_2
filterByBoolMask = List.FilterByBoolMask(list=subassembliesByStation, mask=eq)

# group: Filtern nach Fahrstreifen
name_2 = Autodesk.Civil.DynamoNodes.AppliedSubassembly.Name(appliedSubassembly=subassembliesByStation)
code_block_3 = CodeBlock { "LaneSuperelevationAOR"; }
eq_2 = name_2 == code_block_3
code_block_4 = CodeBlock { "LaneSuperelevationAOR - (Left)"; }
eq_3 = name_2 == code_block_4
filterByBoolMask_2 = List.FilterByBoolMask(list=subassembliesByStation, mask=eq_3)

filterByBoolMask_3 = List.FilterByBoolMask(list=subassembliesByStation, mask=eq_2)

# group: Add on Lanes
parameters = Autodesk.Civil.DynamoNodes.AppliedSubassembly.Parameters(appliedSubassembly=filterByBoolMask_3.in)
name_3 = Autodesk.Civil.DynamoNodes.SubassemblyParameter.Name(subassemblyParameter=parameters)
code_block_5 = CodeBlock()
# ---------- code_block_5.designscript (2 lines) ----------
"Seite";
//Probably need to change to C3D language
# ----------------------------------------
eq_4 = name_3 == code_block_5
filterByBoolMask_4 = List.FilterByBoolMask(list=parameters, mask=eq_4)
value = Autodesk.Civil.DynamoNodes.SubassemblyParameter.Value(subassemblyParameter=filterByBoolMask_4.in)
code_block_6 = CodeBlock { 2; }
flatten_3 = List.Flatten(list=value, amt=code_block_6)
empty_to_null = Python(IN[0]=flatten_3)
# ---------- empty_to_null.python (48 lines) ----------
# Load the Python Standard and DesignScript Libraries
import sys
import clr

# Add Assemblies for AutoCAD and Civil3D
clr.AddReference('AcMgd')
clr.AddReference('AcCoreMgd')
clr.AddReference('AcDbMgd')
clr.AddReference('AecBaseMgd')
clr.AddReference('AecPropDataMgd')
clr.AddReference('AeccDbMgd')

# Import references from AutoCAD
from Autodesk.AutoCAD.Runtime import *
from Autodesk.AutoCAD.ApplicationServices import *
from Autodesk.AutoCAD.EditorInput import *
from Autodesk.AutoCAD.DatabaseServices import *
from Autodesk.AutoCAD.Geometry import *

# Import references from Civil3D
from Autodesk.Civil.ApplicationServices import *
from Autodesk.Civil.DatabaseServices import *

# The inputs to this node will be stored as a list in the IN variables.
dataEnteringNode = IN

adoc = Application.DocumentManager.MdiActiveDocument
editor = adoc.Editor

data=IN[0]
re=[];

with adoc.LockDocument():
    with adoc.Database as db:

        with db.TransactionManager.StartTransaction() as t:
            if data!=None:
                for i in range(len(data)):
                    if len(data[i]) == 0:#check if the list is empty -> replace with none
                        re.append(None)
                        continue
                    re.append(data[i])
            if data==None:
                re=None	        
            pass

# Assign your output to the OUT variable.
OUT = re
# ----------------------------------------
name_4 = Autodesk.Civil.DynamoNodes.SubassemblyParameter.Name(subassemblyParameter=parameters)
code_block_7 = CodeBlock { "Fahrstreifenbreite"; }
eq_5 = name_4 == code_block_7
filterByBoolMask_5 = List.FilterByBoolMask(list=parameters, mask=eq_5)
value_2 = Autodesk.Civil.DynamoNodes.SubassemblyParameter.Value(subassemblyParameter=filterByBoolMask_5.in)
flatten_4 = List.Flatten(list=value_2, amt=code_block_6)
empty_to_null_2 = Python(IN[0]=flatten_4)  # same code as empty_to_null
rightlanes_into_list = Python(IN[0]=empty_to_null, IN[1]=empty_to_null_2)
# ---------- rightlanes_into_list.python (58 lines) ----------
# Load the Python Standard and DesignScript Libraries
import sys
import clr

# Add Assemblies for AutoCAD and Civil3D
clr.AddReference('AcMgd')
clr.AddReference('AcCoreMgd')
clr.AddReference('AcDbMgd')
clr.AddReference('AecBaseMgd')
clr.AddReference('AecPropDataMgd')
clr.AddReference('AeccDbMgd')

# Import references from AutoCAD
from Autodesk.AutoCAD.Runtime import *
from Autodesk.AutoCAD.ApplicationServices import *
from Autodesk.AutoCAD.EditorInput import *
from Autodesk.AutoCAD.DatabaseServices import *
from Autodesk.AutoCAD.Geometry import *

# Import references from Civil3D
from Autodesk.Civil.ApplicationServices import *
from Autodesk.Civil.DatabaseServices import *

# The inputs to this node will be stored as a list in the IN variables.
dataEnteringNode = IN

adoc = Application.DocumentManager.MdiActiveDocument
editor = adoc.Editor

# setup of var
side = IN[0];
data = IN[1];

sum = 0;

right = [];

with adoc.LockDocument():
    with adoc.Database as db:

        with db.TransactionManager.StartTransaction() as t:
            if side != None and data != None:
                for i in range(len(data)):
                    if data[i] == None:  # check if there is a a length for the crosssection
                        right.append(None)
                        continue
                    for j in range(len(data[i])):  # if there are more lanes on one site sum them up
                        if side[i][j][0] == 1:
                            sum += data[i][j][0]

                    right.append(sum)
                    sum = 0
            else:
                right = None
        pass

# Assign your output to the OUT variable.
OUT = right
# ----------------------------------------
flatten_5 = List.Flatten(list=rightlanes_into_list)
python_script = Python(IN[0]=empty_to_null, IN[1]=empty_to_null_2)
# ---------- python_script.python (58 lines) ----------
# Load the Python Standard and DesignScript Libraries
import sys
import clr

# Add Assemblies for AutoCAD and Civil3D
clr.AddReference('AcMgd')
clr.AddReference('AcCoreMgd')
clr.AddReference('AcDbMgd')
clr.AddReference('AecBaseMgd')
clr.AddReference('AecPropDataMgd')
clr.AddReference('AeccDbMgd')

# Import references from AutoCAD
from Autodesk.AutoCAD.Runtime import *
from Autodesk.AutoCAD.ApplicationServices import *
from Autodesk.AutoCAD.EditorInput import *
from Autodesk.AutoCAD.DatabaseServices import *
from Autodesk.AutoCAD.Geometry import *

# Import references from Civil3D
from Autodesk.Civil.ApplicationServices import *
from Autodesk.Civil.DatabaseServices import *

# The inputs to this node will be stored as a list in the IN variables.
dataEnteringNode = IN

adoc = Application.DocumentManager.MdiActiveDocument
editor = adoc.Editor

# setup of var
side = IN[0];
data = IN[1];

sum = 0;

right = [];

with adoc.LockDocument():
    with adoc.Database as db:

        with db.TransactionManager.StartTransaction() as t:
            if side != None and data != None:
                for i in range(len(data)):
                    if data[i] == None:  # check if there is a a length for the crosssection
                        right.append(None)
                        continue
                    for j in range(len(data[i])):  # if there are more lanes on one site sum them up
                        if side[i][j][0] == 0:
                            sum += data[i][j][0]

                    right.append(sum)
                    sum = 0
            else:
                right = None
        pass

# Assign your output to the OUT variable.
OUT = right
# ----------------------------------------
flatten_6 = List.Flatten(list=python_script)
code_block_8 = CodeBlock()
# ---------- code_block_8.designscript (2 lines) ----------
//Left ==1
//Right ==0
# ----------------------------------------

# group: Lane Right
parameters_2 = Autodesk.Civil.DynamoNodes.AppliedSubassembly.Parameters(appliedSubassembly=filterByBoolMask.in)
name_5 = Autodesk.Civil.DynamoNodes.SubassemblyParameter.Name(subassemblyParameter=parameters_2)
code_block_9 = CodeBlock { "Fahrstreifenbreite"; }
eq_6 = name_5 == code_block_9
filterByBoolMask_6 = List.FilterByBoolMask(list=parameters_2, mask=eq_6)
value_3 = Autodesk.Civil.DynamoNodes.SubassemblyParameter.Value(subassemblyParameter=filterByBoolMask_6.in)
code_block_10 = CodeBlock { 2; }
flatten_7 = List.Flatten(list=value_3, amt=code_block_10)
replace_empty_to_null = Python(IN[0]=flatten_7)
# ---------- replace_empty_to_null.python (45 lines) ----------
# Load the Python Standard and DesignScript Libraries
import sys
import clr

# Add Assemblies for AutoCAD and Civil3D
clr.AddReference('AcMgd')
clr.AddReference('AcCoreMgd')
clr.AddReference('AcDbMgd')
clr.AddReference('AecBaseMgd')
clr.AddReference('AecPropDataMgd')
clr.AddReference('AeccDbMgd')

# Import references from AutoCAD
from Autodesk.AutoCAD.Runtime import *
from Autodesk.AutoCAD.ApplicationServices import *
from Autodesk.AutoCAD.EditorInput import *
from Autodesk.AutoCAD.DatabaseServices import *
from Autodesk.AutoCAD.Geometry import *

# Import references from Civil3D
from Autodesk.Civil.ApplicationServices import *
from Autodesk.Civil.DatabaseServices import *

# The inputs to this node will be stored as a list in the IN variables.
dataEnteringNode = IN

adoc = Application.DocumentManager.MdiActiveDocument
editor = adoc.Editor

data=IN[0]
re=[];

with adoc.LockDocument():
    with adoc.Database as db:

        with db.TransactionManager.StartTransaction() as t:
            for i in range(len(data)):
            	if len(data[i]) == 0:#check if the list is empty -> replace with none
            		re.append(None)
            		continue
            	re.append(data[i])
            pass

# Assign your output to the OUT variable.
OUT = re
# ----------------------------------------
flatten_8 = List.Flatten(list=replace_empty_to_null)
custom_sum = Python(IN[0]=flatten_8, IN[1]=flatten_5, IN[2]=flatten)
# ---------- custom_sum.python (64 lines) ----------
# Load the Python Standard and DesignScript Libraries
import sys
import clr

# Add Assemblies for AutoCAD and Civil3D
clr.AddReference('AcMgd')
clr.AddReference('AcCoreMgd')
clr.AddReference('AcDbMgd')
clr.AddReference('AecBaseMgd')
clr.AddReference('AecPropDataMgd')
clr.AddReference('AeccDbMgd')

# Import references from AutoCAD
from Autodesk.AutoCAD.Runtime import *
from Autodesk.AutoCAD.ApplicationServices import *
from Autodesk.AutoCAD.EditorInput import *
from Autodesk.AutoCAD.DatabaseServices import *
from Autodesk.AutoCAD.Geometry import *

# Import references from Civil3D
from Autodesk.Civil.ApplicationServices import *
from Autodesk.Civil.DatabaseServices import *

# The inputs to this node will be stored as a list in the IN variables.
dataEnteringNode = IN

adoc = Application.DocumentManager.MdiActiveDocument
editor = adoc.Editor

x=IN[0];
y=IN[1];
count=IN[2];
#Add your Input here and below

result=[];


with adoc.LockDocument():
    with adoc.Database as db:

        with db.TransactionManager.StartTransaction() as t:
            if x==None and y==None:
            	for i in range(len(count)):
                	result.append(None)
            elif x==None:
                result=y
            elif y==None:
                result=x;
            else:
                for i in range(len(x)):
                    if x[i]==None:#Both null ->null elseif the other get is valid ->set -> else both valid -> add them up
                        if y[i]==None:
                            result.append(None)
                            continue
                        result.append(y[i])
                        continue
                    if y[i]==None:
                        result.append(x[i])
                        continue
                    result.append(x[i]+y[i])
            pass

# Assign your output to the OUT variable.
OUT = result
# ----------------------------------------
code_block_11 = CodeBlock()  # //Rightlane

# group: Lane Left
parameters_3 = Autodesk.Civil.DynamoNodes.AppliedSubassembly.Parameters(appliedSubassembly=filterByBoolMask_2.in)
name_6 = Autodesk.Civil.DynamoNodes.SubassemblyParameter.Name(subassemblyParameter=parameters_3)
code_block_12 = CodeBlock()
# ---------- code_block_12.designscript (2 lines) ----------
"Fahrstreifenbreite";
//Probably need to change to C3D language
# ----------------------------------------
eq_7 = name_6 == code_block_12
filterByBoolMask_7 = List.FilterByBoolMask(list=parameters_3, mask=eq_7)
value_4 = Autodesk.Civil.DynamoNodes.SubassemblyParameter.Value(subassemblyParameter=filterByBoolMask_7.in)
code_block_13 = CodeBlock { 2; }
flatten_9 = List.Flatten(list=value_4, amt=code_block_13)
replace_empty_to_null_2 = Python(IN[0]=flatten_9)  # same code as replace_empty_to_null
flatten_10 = List.Flatten(list=replace_empty_to_null_2)
python_script_2 = Python(IN[0]=flatten_10, IN[1]=flatten_6, IN[2]=flatten)  # same code as custom_sum
code_block_14 = CodeBlock()  # //leftlane

alignment = Autodesk.Civil.DynamoNodes.Baseline.Alignment(baseline=baselines)
unzip_alignment = Python(IN[0]=alignment)
# ---------- unzip_alignment.python (38 lines) ----------
# Load the Python Standard and DesignScript Libraries
import sys
import clr

# Add Assemblies for AutoCAD and Civil3D
clr.AddReference('AcMgd')
clr.AddReference('AcCoreMgd')
clr.AddReference('AcDbMgd')
clr.AddReference('AecBaseMgd')
clr.AddReference('AecPropDataMgd')
clr.AddReference('AeccDbMgd')

# Import references from AutoCAD
from Autodesk.AutoCAD.Runtime import *
from Autodesk.AutoCAD.ApplicationServices import *
from Autodesk.AutoCAD.EditorInput import *
from Autodesk.AutoCAD.DatabaseServices import *
from Autodesk.AutoCAD.Geometry import *

# Import references from Civil3D
from Autodesk.Civil.ApplicationServices import *
from Autodesk.Civil.DatabaseServices import *

# The inputs to this node will be stored as a list in the IN variables.
dataEnteringNode = IN

adoc = Application.DocumentManager.MdiActiveDocument
editor = adoc.Editor

with adoc.LockDocument():
    with adoc.Database as db:

        with db.TransactionManager.StartTransaction() as t:
            
            pass

# Assign your output to the OUT variable.
OUT = IN[0][0]
# ----------------------------------------
flatten_11 = List.Flatten(list=stations)
getSlopeAtStation = Autodesk.Civil.DynamoNodes.AlignmentExtensions.GetSlopeAtStation(alignment=unzip_alignment, station=flatten_11)

# group: Lane left Superelevation
name_7 = Autodesk.Civil.DynamoNodes.SubassemblyParameter.Name(subassemblyParameter=parameters_3)
code_block_15 = CodeBlock()
# ---------- code_block_15.designscript (2 lines) ----------
"Vorgabeneigung";
//Probably need to change to C3D language
# ----------------------------------------
eq_8 = name_7 == code_block_15
filterByBoolMask_8 = List.FilterByBoolMask(list=parameters_3, mask=eq_8)
value_5 = Autodesk.Civil.DynamoNodes.SubassemblyParameter.Value(subassemblyParameter=filterByBoolMask_8.in)
flatten_12 = List.Flatten(list=value_5, amt=code_block_13)
replace_empty_to_0 = Python(IN[0]=flatten_12)
# ---------- replace_empty_to_0.python (45 lines) ----------
# Load the Python Standard and DesignScript Libraries
import sys
import clr

# Add Assemblies for AutoCAD and Civil3D
clr.AddReference('AcMgd')
clr.AddReference('AcCoreMgd')
clr.AddReference('AcDbMgd')
clr.AddReference('AecBaseMgd')
clr.AddReference('AecPropDataMgd')
clr.AddReference('AeccDbMgd')

# Import references from AutoCAD
from Autodesk.AutoCAD.Runtime import *
from Autodesk.AutoCAD.ApplicationServices import *
from Autodesk.AutoCAD.EditorInput import *
from Autodesk.AutoCAD.DatabaseServices import *
from Autodesk.AutoCAD.Geometry import *

# Import references from Civil3D
from Autodesk.Civil.ApplicationServices import *
from Autodesk.Civil.DatabaseServices import *

# The inputs to this node will be stored as a list in the IN variables.
dataEnteringNode = IN

adoc = Application.DocumentManager.MdiActiveDocument
editor = adoc.Editor

data=IN[0]
re=[];

with adoc.LockDocument():
    with adoc.Database as db:

        with db.TransactionManager.StartTransaction() as t:
            for i in range(len(data)):
            	if len(data[i]) == 0:#check if the list is empty -> replace with none
            		re.append(0)
            		continue
            	re.append(data[i])
            pass

# Assign your output to the OUT variable.
OUT = re
# ----------------------------------------
flatten_13 = List.Flatten(list=replace_empty_to_0)
add = flatten_13 + getSlopeAtStation.LeftOutLaneCrossSlope

# group: Lane right Superelevation
name_8 = Autodesk.Civil.DynamoNodes.SubassemblyParameter.Name(subassemblyParameter=parameters_2)
eq_9 = name_8 == code_block_15
filterByBoolMask_9 = List.FilterByBoolMask(list=parameters_2, mask=eq_9)
value_6 = Autodesk.Civil.DynamoNodes.SubassemblyParameter.Value(subassemblyParameter=filterByBoolMask_9.in)
flatten_14 = List.Flatten(list=value_6, amt=code_block_13)
replace_empty_to_0_2 = Python(IN[0]=flatten_14)  # same code as replace_empty_to_0
flatten_15 = List.Flatten(list=replace_empty_to_0_2)
add_2 = flatten_15 + getSlopeAtStation.RightOutLaneCrossSlope

# group: packaging + test output
list_create = List.Create(item0=flatten, item1=flatten_2, item2=custom_sum, item3=python_script_2, item4=add, item5=add_2)
transpose = List.Transpose(lists=list_create)
code_block_16 = CodeBlock { 3; }
round = Math.Round(number=transpose, digits=code_block_16)
output_Selection = Python(IN[0]=round)
# ---------- output_Selection.python (66 lines) ----------
# Load the Python Standard and DesignScript Libraries
import sys
import clr

# Add Assemblies for AutoCAD and Civil3D
clr.AddReference('AcMgd')
clr.AddReference('AcCoreMgd')
clr.AddReference('AcDbMgd')
clr.AddReference('AecBaseMgd')
clr.AddReference('AecPropDataMgd')
clr.AddReference('AeccDbMgd')

# Import references from AutoCAD
from Autodesk.AutoCAD.Runtime import *
from Autodesk.AutoCAD.ApplicationServices import *
from Autodesk.AutoCAD.EditorInput import *
from Autodesk.AutoCAD.DatabaseServices import *
from Autodesk.AutoCAD.Geometry import *

# Import references from Civil3D
from Autodesk.Civil.ApplicationServices import *
from Autodesk.Civil.DatabaseServices import *

# The inputs to this node will be stored as a list in the IN variables.
dataEnteringNode = IN

adoc = Application.DocumentManager.MdiActiveDocument
editor = adoc.Editor

data = IN[0];
ret=[data[0]];

#TODO Add Offset 
#maybe here are some info: http://docs.autodesk.com/CIV3D/2019/ENU/API_Reference_Guide/index.html



with adoc.LockDocument():
    with adoc.Database as db:

        with db.TransactionManager.StartTransaction() as t:
        #fancy Output
            for i in range(len(data)):
                editor.WriteMessage("\n")
                if (i == 0):  # First crosssection 
                    for j in range(len(data[i])):#Crosssection output
                        editor.WriteMessage("\t" + str(data[i][j]))

                    editor.WriteMessage("\t" + str(0.000))  # Here add the Offset
                    editor.WriteMessage("\t" + str(0.000))
                    continue
				#Check if the crosssection has changed
                for n in range(len(data[i])-2):
                	if data[i][n+2]!=data[i-1][n+2]:
						for j in range(len(data[i])):#Crosssection output
							editor.WriteMessage("\t" + str(data[i][j]))
							
						editor.WriteMessage("\t"+ str(0.0))
						editor.WriteMessage("\t"+ str(0.0))
						ret.append(data[i]);						
						break

            pass

# Assign your output to the OUT variable.
OUT = ret
# ----------------------------------------
code_block_17 = CodeBlock()
# ---------- code_block_17.designscript (2 lines) ----------
//IF Math.Round throw a warning then there
//is probably a unknown crosssection
# ----------------------------------------

# group: Export_Excel
file_path = Filename("..\Export\simple_export.csv")
addItemToFront = List.AddItemToFront(item=code_block, list=output_Selection)
exportCSV = Data.ExportCSV(filePath=file_path, data=addItemToFront)

# group: Not necessary
startStation = Autodesk.Civil.DynamoNodes.BaselineRegion.StartStation(baselineRegion=regions)
subassembliesByStation_2 = Autodesk.Civil.DynamoNodes.Baseline.SubassembliesByStation(baseline=baselines, station=startStation)
parameters_4 = Autodesk.Civil.DynamoNodes.AppliedSubassembly.Parameters(appliedSubassembly=subassembliesByStation_2)
flatten_16 = List.Flatten(list=parameters_4)
name_9 = Autodesk.Civil.DynamoNodes.SubassemblyParameter.Name(subassemblyParameter=flatten_16)
value_7 = Autodesk.Civil.DynamoNodes.SubassemblyParameter.Value(subassemblyParameter=flatten_16)
name_10 = Autodesk.Civil.DynamoNodes.AppliedSubassembly.Name(appliedSubassembly=subassembliesByStation_2)
code_block_18 = CodeBlock { "LaneSuperelevationAOR - (Left)"; }
eq_10 = name_10 == code_block_18
code_block_19 = CodeBlock { "LaneSuperelevationAOR - (Right)"; }
eq_11 = name_10 == code_block_19
or_ = eq_10 || eq_11
code_block_20 = CodeBlock { "LaneSuperelevationAOR"; }
eq_12 = name_10 == code_block_20
or_2 = or_ || eq_12
filterByBoolMask_10 = List.FilterByBoolMask(list=subassembliesByStation_2, mask=or_2)

code_block_21 = CodeBlock { /*Export der Daten an den Stützstellen*/; }
code_block_22 = CodeBlock()  # //Currently only the first Alingement
code_block_23 = CodeBlock()  # //Z Point always zero maybe a error

# group: Alingment to Point
code_block_24 = CodeBlock { 2.5; }
stations_2 = Autodesk.Civil.DynamoNodes.Alignment.Stations(alignment=alignmentselection, interval=code_block_24)
coordinateSystemByStationOffset = Autodesk.Civil.DynamoNodes.Alignment.CoordinateSystemByStationOffset(alignment=unzip_alignment, station=stations_2)
code_block_25 = CodeBlock { 0; }
byCartesianCoordinates = Point.ByCartesianCoordinates(cs=coordinateSystemByStationOffset, x=code_block_25, y=code_block_25, z=code_block_25)
X = Point.X(point=byCartesianCoordinates)
Y = Point.Y(point=byCartesianCoordinates)
Z = Point.Z(point=byCartesianCoordinates)

# group: Testing for smaller Sections
python_script_3 = Python(IN[0]=output_Selection)
# ---------- python_script_3.python (44 lines) ----------
# Load the Python Standard and DesignScript Libraries
import sys
import clr

# Add Assemblies for AutoCAD and Civil3D
clr.AddReference('AcMgd')
clr.AddReference('AcCoreMgd')
clr.AddReference('AcDbMgd')
clr.AddReference('AecBaseMgd')
clr.AddReference('AecPropDataMgd')
clr.AddReference('AeccDbMgd')

# Import references from AutoCAD
from Autodesk.AutoCAD.Runtime import *
from Autodesk.AutoCAD.ApplicationServices import *
from Autodesk.AutoCAD.EditorInput import *
from Autodesk.AutoCAD.DatabaseServices import *
from Autodesk.AutoCAD.Geometry import *

# Import references from Civil3D
from Autodesk.Civil.ApplicationServices import *
from Autodesk.Civil.DatabaseServices import *

# The inputs to this node will be stored as a list in the IN variables.
dataEnteringNode = IN

adoc = Application.DocumentManager.MdiActiveDocument
editor = adoc.Editor
reg=[];

with adoc.LockDocument():
    with adoc.Database as db:

        with db.TransactionManager.StartTransaction() as t:
            # Place your code below
            # 
            for j in range(len(IN[0])):
            	reg.append(IN[0][j][0]); 
            # Commit before end transaction
            #t.Commit()
            pass

# Assign your output to the OUT variable.
OUT = reg;
# ----------------------------------------
python_script_4 = Python(IN[0]=output_Selection)
# ---------- python_script_4.python (44 lines) ----------
# Load the Python Standard and DesignScript Libraries
import sys
import clr

# Add Assemblies for AutoCAD and Civil3D
clr.AddReference('AcMgd')
clr.AddReference('AcCoreMgd')
clr.AddReference('AcDbMgd')
clr.AddReference('AecBaseMgd')
clr.AddReference('AecPropDataMgd')
clr.AddReference('AeccDbMgd')

# Import references from AutoCAD
from Autodesk.AutoCAD.Runtime import *
from Autodesk.AutoCAD.ApplicationServices import *
from Autodesk.AutoCAD.EditorInput import *
from Autodesk.AutoCAD.DatabaseServices import *
from Autodesk.AutoCAD.Geometry import *

# Import references from Civil3D
from Autodesk.Civil.ApplicationServices import *
from Autodesk.Civil.DatabaseServices import *

# The inputs to this node will be stored as a list in the IN variables.
dataEnteringNode = IN

adoc = Application.DocumentManager.MdiActiveDocument
editor = adoc.Editor
reg=[];

with adoc.LockDocument():
    with adoc.Database as db:

        with db.TransactionManager.StartTransaction() as t:
            # Place your code below
            # 
            for j in range(len(IN[0])):
            	reg.append(IN[0][j][2]);
            # Commit before end transaction
            #t.Commit()
            pass

# Assign your output to the OUT variable.
OUT = reg;
# ----------------------------------------
python_script_5 = Python(IN[0]=output_Selection)
# ---------- python_script_5.python (44 lines) ----------
# Load the Python Standard and DesignScript Libraries
import sys
import clr

# Add Assemblies for AutoCAD and Civil3D
clr.AddReference('AcMgd')
clr.AddReference('AcCoreMgd')
clr.AddReference('AcDbMgd')
clr.AddReference('AecBaseMgd')
clr.AddReference('AecPropDataMgd')
clr.AddReference('AeccDbMgd')

# Import references from AutoCAD
from Autodesk.AutoCAD.Runtime import *
from Autodesk.AutoCAD.ApplicationServices import *
from Autodesk.AutoCAD.EditorInput import *
from Autodesk.AutoCAD.DatabaseServices import *
from Autodesk.AutoCAD.Geometry import *

# Import references from Civil3D
from Autodesk.Civil.ApplicationServices import *
from Autodesk.Civil.DatabaseServices import *

# The inputs to this node will be stored as a list in the IN variables.
dataEnteringNode = IN

adoc = Application.DocumentManager.MdiActiveDocument
editor = adoc.Editor
reg=[];

with adoc.LockDocument():
    with adoc.Database as db:

        with db.TransactionManager.StartTransaction() as t:
            # Place your code below
            # 
            for j in range(len(IN[0])):
            	reg.append(IN[0][j][3]);
            # Commit before end transaction
            #t.Commit()
            pass

# Assign your output to the OUT variable.
OUT = reg;
# ----------------------------------------
python_script_6 = Python(IN[0]=output_Selection)
# ---------- python_script_6.python (44 lines) ----------
# Load the Python Standard and DesignScript Libraries
import sys
import clr

# Add Assemblies for AutoCAD and Civil3D
clr.AddReference('AcMgd')
clr.AddReference('AcCoreMgd')
clr.AddReference('AcDbMgd')
clr.AddReference('AecBaseMgd')
clr.AddReference('AecPropDataMgd')
clr.AddReference('AeccDbMgd')

# Import references from AutoCAD
from Autodesk.AutoCAD.Runtime import *
from Autodesk.AutoCAD.ApplicationServices import *
from Autodesk.AutoCAD.EditorInput import *
from Autodesk.AutoCAD.DatabaseServices import *
from Autodesk.AutoCAD.Geometry import *

# Import references from Civil3D
from Autodesk.Civil.ApplicationServices import *
from Autodesk.Civil.DatabaseServices import *

# The inputs to this node will be stored as a list in the IN variables.
dataEnteringNode = IN

adoc = Application.DocumentManager.MdiActiveDocument
editor = adoc.Editor
reg=[];

with adoc.LockDocument():
    with adoc.Database as db:

        with db.TransactionManager.StartTransaction() as t:
            # Place your code below
            # 
            for j in range(len(IN[0])):
            	reg.append(IN[0][j][4]);
            # Commit before end transaction
            #t.Commit()
            pass

# Assign your output to the OUT variable.
OUT = reg;
# ----------------------------------------
python_script_7 = Python(IN[0]=output_Selection)
# ---------- python_script_7.python (44 lines) ----------
# Load the Python Standard and DesignScript Libraries
import sys
import clr

# Add Assemblies for AutoCAD and Civil3D
clr.AddReference('AcMgd')
clr.AddReference('AcCoreMgd')
clr.AddReference('AcDbMgd')
clr.AddReference('AecBaseMgd')
clr.AddReference('AecPropDataMgd')
clr.AddReference('AeccDbMgd')

# Import references from AutoCAD
from Autodesk.AutoCAD.Runtime import *
from Autodesk.AutoCAD.ApplicationServices import *
from Autodesk.AutoCAD.EditorInput import *
from Autodesk.AutoCAD.DatabaseServices import *
from Autodesk.AutoCAD.Geometry import *

# Import references from Civil3D
from Autodesk.Civil.ApplicationServices import *
from Autodesk.Civil.DatabaseServices import *

# The inputs to this node will be stored as a list in the IN variables.
dataEnteringNode = IN

adoc = Application.DocumentManager.MdiActiveDocument
editor = adoc.Editor
reg=[];

with adoc.LockDocument():
    with adoc.Database as db:

        with db.TransactionManager.StartTransaction() as t:
            # Place your code below
            # 
            for j in range(len(IN[0])):
            	reg.append(IN[0][j][5]);
            # Commit before end transaction
            #t.Commit()
            pass

# Assign your output to the OUT variable.
OUT = reg;
# ----------------------------------------

# group: IFC_Export
createIfcModel = IfcInfraToolKit_DynamoCore.IfcModelSetup.CreateIfcModel()
code_block_26 = CodeBlock { "BaseAlignment"; }
ifcAddAlignmentByPoints = IfcInfraToolkit_Dyn.Alignment.IfcAddAlignmentByPoints(databaseContainer=createIfcModel, Alignmentname=code_block_26, x=X, y=Y, z=Z)
IFCAddRoad = IfcInfraToolkit_Dyn.Road.IFCAddRoad(databaseContainer=ifcAddAlignmentByPoints.DatabaseContainer, hostGuid=ifcAddAlignmentByPoints.AlignmentGUID)
ifcRoadAddGeometry = IfcInfraToolkit_Dyn.Road.IfcRoadAddGeometry(databaseContainer=IFCAddRoad.DatabaseContainer, RoadGuid=IFCAddRoad.RoadGUID, AlignmentGuid=ifcAddAlignmentByPoints.AlignmentGUID, stations=python_script_3, width_left=python_script_4, width_right=python_script_5, slope_left=python_script_6, slope_right=python_script_7)
code_block_27 = CodeBlock { "sample_ifcroad"; "test"; }
saveIfcModel = IfcInfraToolKit_DynamoCore.IfcModelSetup.SaveIfcModel(container=ifcRoadAddGeometry.DatabaseContainer, path=code_block_27.out0, modelName=code_block_27.out1)
