# Dynamo graph simple_alignment_export.dyn (Dynamo 2.5.1.7586)

createIfcModel = IfcInfraToolKit_DynamoCore.IfcModelSetup.CreateIfcModel()
civil3DApplication = IfcInfraToolkit_Dyn.Civil3DApplication.Civil3DApplication()
getDocuments = IfcInfraToolkit_Dyn.Civil3DApplication.GetDocuments(Civil3DApplication=civil3DApplication)
getAlignments = IfcInfraToolkit_Dyn.Civil3DDocument.GetAlignments(Civil3DDocument=getDocuments)
boolean = BoolSelector(false)
integer_slider = IntegerSlider(2, range=0..100 step 1)
ifcAddAlignmentByCurve = IfcInfraToolkit_Dyn.Alignment.IfcAddAlignmentByCurve(databaseContainer=createIfcModel, alignment=getAlignments, twoDim=boolean, profilnum=integer_slider)
watchIFC = IfcInfraToolKit_DynamoCore.IfcModelSetup.WatchIFC(databaseContainer=ifcAddAlignmentByCurve.DatabaseContainer)
code_block = CodeBlock { "export"; "Sample_Alignment_RC2"; }
saveIfcModel = IfcInfraToolKit_DynamoCore.IfcModelSetup.SaveIfcModel(container=ifcAddAlignmentByCurve.DatabaseContainer, path=code_block.out0, modelName=code_block.out1)
